# Grasshopper definition MT001 - AB Comments.gh (Grasshopper 0.9.76)

number_slider = Slider(18, range=0..20)
# Errors in Red
# Success in Green
# Corrections in Blue
# Unnecessary in Orange
# 0: Numbers in panels relate to the numbers on the groups.
# I'm related to the "0" Panel
# Question: Question regarding the attractor assignment.
# 
# I have attached a picture what I would like to have my geometry to be (monad??). my plan was to perform the following transformations in order rotate, scale, move, loft, cap, and the have an extrusion to a point on the top of that solid.
# 
# I am having issues getting a loft to work in my script.
# 
# I also know how I want to create the (sharpness) but I am struggling on figuring out how to actually do it (see picture and script) - essentially I need a point to extrude to directly above the center point of my polygon (I just don't know how to create the point)
# 
# And finally I would like to splay the polygons away from my attractor curve (so the polygons on the curve are vertical and the polygons start to point outwards the further from the curve you get, I know i need to create vectors to rotate along, but am have trouble figuring out how to execute.
number_slider_2 = Slider(2, range=0..10)
pt = Point(<point referenced from the Rhino model>)
hexgrid = Hexagonal(Plane=PlaneXY(0, 0, 0), Size=number_slider_2, ExtentX=number_slider, ExtentY=number_slider)  # -> Cells, Points
vec2pt = Vector2Pt(PointA=pt, PointB=hexgrid.Points, Unitize=False)  # -> Vector, Length
crv = Curve(<curve referenced from the Rhino model>)
vdis = VectorDisplay(Anchor=pt, Vector=vec2pt.Vector)
crv_cp = CurveClosestPoint(Point=hexgrid.Points, Curve=crv)  # -> Point, Parameter, Distance
pt_2 = Point(<point referenced from the Rhino model>)
graft = GraftTree(Tree=pt_2, IncludeEmptyLists=True, IncludeNullItems=True)

# ---- group: Sides
dom = ConstructDomain(DomainStart=Slider(0, range=0..20), DomainEnd=Slider(15, range=0..50))
remap = RemapNumbers(Value=crv_cp.Distance, Source=dom, Target=Domain(0, 1))  # -> Mapped, Clipped
graph = GraphMapper(
    remap.Clipped,
    x0=0,
    x1=1,
    y0=0,
    y1=1,
    A=1.024589151,
    B=0,
    container_name="Linear",
    Graph_x0=0,
    Graph_x1=0.9760009646,
    Graph_y0=0,
    Graph_y1=1)
dom_2 = ConstructDomain(DomainStart=Slider(8, range=0..20), DomainEnd=Slider(0, range=0..30))
remap_2 = RemapNumbers(Value=graph, Source=Domain(0, 1), Target=dom_2)  # -> Mapped, Clipped

# ---- group: Radius
dom_3 = ConstructDomain(DomainStart=Slider(0, range=0..20), DomainEnd=Slider(12.3, range=0..50))
remap_3 = RemapNumbers(Value=crv_cp.Distance, Source=dom_3, Target=Domain(0, 1))  # -> Mapped, Clipped
graph_2 = GraphMapper(
    remap_3.Clipped,
    x0=0,
    x1=1,
    y0=0,
    y1=1,
    A=0.7623188496,
    B=0,
    container_name="Linear",
    Graph_x0=0,
    Graph_x1=1,
    Graph_y0=0,
    Graph_y1=0.7623188496)
dom_4 = ConstructDomain(DomainStart=Slider(3, range=0..10), DomainEnd=Slider(0, range=0..30))
remap_4 = RemapNumbers(Value=graph_2, Source=Domain(0, 1), Target=dom_4)  # -> Mapped, Clipped

# ---- group: 4
dom_5 = ConstructDomain(DomainStart=Slider(0, range=0..20), DomainEnd=Slider(10.3, range=0..50))
remap_5 = RemapNumbers(Value=crv_cp.Distance, Source=dom_5, Target=Domain(0, 1))  # -> Mapped, Clipped
graph_3 = GraphMapper(
    remap_5.Clipped,
    x0=0,
    x1=1,
    y0=0,
    y1=1,
    A=1.024589151,
    B=0,
    container_name="Linear",
    Graph_x0=0,
    Graph_x1=0.9760009646,
    Graph_y0=0,
    Graph_y1=1)
dom_6 = ConstructDomain(DomainStart=Slider(2.86, range=0..20), DomainEnd=Slider(3.625, range=0..30))
remap_6 = RemapNumbers(Value=graph_3, Source=Domain(0, 1), Target=dom_6)  # -> Mapped, Clipped

# ---- group: Extrude
dom_7 = ConstructDomain(DomainStart=Slider(0, range=0..20), DomainEnd=Slider(10.3, range=0..50))
remap_7 = RemapNumbers(Value=crv_cp.Distance, Source=dom_7, Target=Domain(0, 1))  # -> Mapped, Clipped
graph_4 = GraphMapper(remap_7.Clipped, x0=0, x1=1, y0=0, y1=1, container_name="Sine", Equation_px=[0, 1], Equation_py=[0, 1])
dom_8 = ConstructDomain(DomainStart=Slider(6.7, range=0..20), DomainEnd=Slider(0, range=0..30))
remap_8 = RemapNumbers(Value=graph_4, Source=Domain(0, 1), Target=dom_8)  # -> Mapped, Clipped

# ---- group: Move
dom_9 = ConstructDomain(DomainStart=Slider(0, range=0..20), DomainEnd=Slider(10.3, range=0..50))
remap_9 = RemapNumbers(Value=crv_cp.Distance, Source=dom_9, Target=Domain(0, 1))  # -> Mapped, Clipped
graph_5 = GraphMapper(
    remap_9.Clipped,
    x0=0,
    x1=1,
    y0=0,
    y1=1,
    A=1.024589151,
    B=0,
    container_name="Linear",
    Graph_x0=0,
    Graph_x1=0.9760009646,
    Graph_y0=0,
    Graph_y1=1)
dom_10 = ConstructDomain(DomainStart=Slider(6.75, range=0..20), DomainEnd=Slider(0, range=0..30))
remap_10 = RemapNumbers(Value=graph_5, Source=Domain(0, 1), Target=dom_10)  # -> Mapped, Clipped

# ---- group: Scale
dom_11 = ConstructDomain(DomainStart=Slider(7.5, range=0..20), DomainEnd=Slider(0, range=0..50))
remap_11 = RemapNumbers(Value=crv_cp.Distance, Source=dom_11, Target=Domain(0, 1))  # -> Mapped, Clipped
graph_6 = GraphMapper(
    remap_11.Clipped,
    x0=0,
    x1=1,
    y0=0,
    y1=1,
    A=0.5913370391,
    B=0.1021657402,
    container_name="Linear",
    Graph_x0=0.25,
    Graph_x1=0.9078956842,
    Graph_y0=0.25,
    Graph_y1=0.6390380859)
dom_12 = ConstructDomain(DomainStart=Slider(1, range=0..3), DomainEnd=Slider(1.223, range=1..3))
remap_12 = RemapNumbers(Value=graph_6, Source=Domain(0, 1), Target=dom_12)  # -> Mapped, Clipped

# ----
dist = Distance(PointA=graft)

# ---- group: Proximity of effect
dom_13 = ConstructDomain(DomainStart=Slider(0, range=0..20), DomainEnd=Slider(86, range=0..300))

# ---- group: Offset / Proximity of effect
dom_14 = ConstructDomain(DomainStart=Slider(0, range=0..20), DomainEnd=Slider(150, range=0..300))

# ----
flip = FlipMatrix(Data=dist)
sort = SortList(Keys=flip)  # -> Keys, ValuesA
item = ListItem(List=sort.Keys, Index=0, Wrap=True)
flatten = FlattenTree(Tree=item, Path="{0}")

# ---- group: Max/Min of Effect
dom_15 = ConstructDomain(DomainStart=Slider(6, range=3..6), DomainEnd=Slider(3, range=0..20))

# ----
remap_13 = RemapNumbers(Value=flatten, Source=dom_13, Target=Domain(0, 1))  # -> Mapped, Clipped

# ---- group: Offset / Max/Min of Effect
dom_16 = ConstructDomain(DomainStart=Slider(0, range=0..6), DomainEnd=Slider(145, range=0..180))

# ---- group: Offset
pt_3 = Point([<point referenced from the Rhino model> x3])
graft_2 = GraftTree(Tree=pt_3, IncludeEmptyLists=True, IncludeNullItems=True)
dist_2 = Distance(PointA=graft_2, PointB=hexgrid.Points)
flip_2 = FlipMatrix(Data=dist_2)
sort_2 = SortList(Keys=flip_2)  # -> Keys, ValuesA
item_2 = ListItem(List=sort_2.Keys, Index=0, Wrap=True)
flatten_2 = FlattenTree(Tree=item_2, Path="{0}")
remap_14 = RemapNumbers(Value=flatten_2, Source=dom_14, Target=Domain(0, 1))  # -> Mapped, Clipped
fallout = GraphMapper(
    remap_14.Clipped,
    x0=0,
    x1=1,
    y0=0,
    y1=1,
    A=1.0080632,
    B=-0.002015800017,
    container_name="Linear",
    Graph_x0=0.25,
    Graph_x1=0.9940009713,
    Graph_y0=0.25,
    Graph_y1=1)
remap_15 = RemapNumbers(Value=fallout, Source=Domain(0, 1), Target=dom_16)  # -> Mapped, Clipped

# ----
fallout_2 = GraphMapper(
    remap_13.Clipped,
    x0=0,
    x1=1,
    y0=0,
    y1=1,
    A=1,
    B=0,
    container_name="Linear",
    Graph_x0=0.25,
    Graph_x1=0.75,
    Graph_y0=0.25,
    Graph_y1=0.75)
polygon = Polygon(Plane=hexgrid.Points, Radius=remap_4.Mapped, Segments=remap_2.Mapped, FilletRadius=0)  # -> Polygon, Length
remap_16 = RemapNumbers(Value=fallout_2, Source=Domain(0, 1), Target=dom_15)  # -> Mapped, Clipped
Z = UnitZ(Factor=remap_8.Mapped)
vec = VectorXYZ(XComponent=0, YComponent=0, ZComponent=remap_10.Mapped)  # -> Vector, Length
srf = Surface()
crv_2 = Curve(polygon.Polygon)
rotate = Rotate(Geometry=polygon.Polygon, Angle=degrees(remap_15.Mapped), Plane=hexgrid.Points)  # -> Geometry, Transform
scale = Scale(Geometry=rotate.Geometry, Center=hexgrid.Points, Factor=remap_12.Mapped)  # -> Geometry, Transform
extr = Extrude(Base=rotate.Geometry, Direction=Z)

# ----
# extrude this surface to a point to create "sharpness"
move = Move(Geometry=scale.Geometry, Motion=vec.Vector)  # -> Geometry, Transform

vec2pt_2 = Vector2Pt(PointA=hexgrid.Points, Unitize=vec.Vector)  # -> Vector, Length
cap = CapHoles(Brep=extr)

# ---- group: 2
# 2: Loft can be a bit fussy.
# The branches need to be exactly the same. I've simplified both grafts so they are.
# PLUS
# Loft dies if it has a null input (which you do, generated by all those 0,1,2 sided polygons). Clean tree removes all the nulls from the lists, so Loft doesn't die. (Its unusual that Loft is one of the only functions that completely stops if it has a null. Most other functions soldier on).
# Why isn't this lofting the two curves?
graft_3 = GraftTree(Tree=polygon.Polygon, IncludeEmptyLists=True, IncludeNullItems=True)  # -> simplify(Tree)
graft_4 = GraftTree(Tree=move.Geometry, IncludeEmptyLists=True, IncludeNullItems=True)  # -> simplify(Tree)
clean = CleanTree(RemoveNulls=True, RemoveInvalid=True, RemoveEmpty=False, Tree=[graft_3, graft_4])

# ----
# 1: The sharp BREPS are then joined with the now working loft and capped.
loft = Loft(Curves=clean, Options={Adjust=False, Closed=False, LoftEnds=0, LoftSimp=0, LoftType=0, Rebuild=10, Refit=0.01})

# ---- group: 1
# 1: So, for the sharp points, you need to define a point for each curve for it to work.
# Here, I've grabbed the centre point, and moved it with a new attractor value at 4.
# Amplitude is used so if you change the extrude vector of the base of the stem, then your points will follow the same vector direction, with a different amplitude.
amp = Amplitude(Vector=vec.Vector, Amplitude=remap_6.Mapped)
area = Area(Geometry=move.Geometry)  # -> Area, Centroid
move_2 = Move(Geometry=area.Centroid, Motion=amp)  # -> Geometry, Transform
extr_2 = ExtrudePoint(Base=move.Geometry, Point=move_2.Geometry)
# How do I create a point z distance above the center of the polygon that I can extrude to a point?
# Is it possible to rotate the shapes away from the attractor curve? (so the polygons on the curve point verticle and the the other polygons point away from the curve?
graft_5 = GraftTree(Tree=extr_2, IncludeEmptyLists=True, IncludeNullItems=True)  # -> simplify(Tree)
merge = Merge(Data1=loft, Data2=graft_5)
join = BrepJoin(Breps=merge)  # -> Breps, Closed
cap_2 = CapHoles(Brep=join.Breps)

# ---- group: 3
# 3: In order to rotate the prisms, we can use the attractor values, as the further a prism gets from the line, it can rotate.
number_slider_3 = Slider(0, range=0..20)
dom_17 = ConstructDomain(DomainStart=number_slider_3, DomainEnd=Slider(10.3, range=0..50))
remap_17 = RemapNumbers(Value=crv_cp.Distance, Source=dom_17, Target=Domain(0, 1))  # -> Mapped, Clipped
graph_7 = GraphMapper(
    remap_17.Clipped,
    x0=0,
    x1=1,
    y0=0,
    y1=1,
    A=1.024589151,
    B=0,
    container_name="Linear",
    Graph_x0=0,
    Graph_x1=0.9760009646,
    Graph_y0=0,
    Graph_y1=1)
dom_18 = ConstructDomain(DomainStart=Slider(0, range=0..20), DomainEnd=Slider(44.108, range=0..180))
remap_18 = RemapNumbers(Value=graph_7, Source=Domain(0, 1), Target=dom_18)  # -> Mapped, Clipped
graft_6 = GraftTree(Tree=remap_18.Mapped, IncludeEmptyLists=True, IncludeNullItems=True)
pt_4 = Point(hexgrid.Points)
pt_5 = Point(crv_cp.Point)
vec2pt_3 = Vector2Pt(PointA=pt_4, PointB=pt_5, Unitize=False)  # -> Vector, Length
# 3: We then need to define a plane for rotation. The Closest Point on Curve function not only outputs distances, but also the actual point on the curve.
# With a plane set at the center of each polygon, we align that planes x direction to a point vector from the center to the line point.
# We then break that plane down into its vectors, as this is a simple way of producing a perpendicular plane. X and Z are used to construct our plane for rotation. If we didn't align the original plane, the X direction would be wrong.
xy = XYPlane(Origin=pt_4)
align = AlignPlane(Plane=xy, Direction=vec2pt_3.Vector)  # -> Plane, Angle
deplane = DeconstructPlane(Plane=align.Plane)  # -> Origin, XAxis, YAxis, ZAxis
pl = ConstructPlane(Origin=deplane.Origin, XAxis=deplane.XAxis, YAxis=deplane.ZAxis)  # -> simplify(Plane)
graft_7 = GraftTree(Tree=pl, IncludeEmptyLists=True, IncludeNullItems=True)
# 3: We then rotate everything once its been formed (otherwise we would have to rotate every element seperately).
rotate_2 = Rotate(Geometry=cap_2, Angle=degrees(graft_6), Plane=graft_7)  # -> Geometry, Transform
