# Grasshopper definition RJ003 - AB Comments.gh (Grasshopper 0.9.76)

panel = Panel("Extrusion Height")
pt = Point(<point referenced from the Rhino model>)
pt_2 = Point(<point referenced from the Rhino model>)

# ---- group: 2
# Length of each individual square
# 2: The main factor of the breaking boolean was just tolerance. Booleans sometimes dont work just because the right edge is in the wrong place.
# Here I just adjusted the rectangle values to be slightly bigger, only by a fraction. And the boolean is now working.
number_slider = Slider(20, range=0..100)
# Width of each individual square
number_slider_2 = Slider(17, range=0..100)

# ----
pt_3 = Point(<point referenced from the Rhino model>)
pt_4 = Point(<point referenced from the Rhino model>)
pt_5 = Point(<point referenced from the Rhino model>)
# Density of rotation from the attractors
pt_6 = Point(<point referenced from the Rhino model>)
pt_7 = Point(<point referenced from the Rhino model>)
pt_8 = Point(<point referenced from the Rhino model>)
rectangle = Rectangle(Plane="-200, -200, 0", XSize=Slider(150, range=0..150), YSize=Slider(120, range=0..120), Radius=0)  # -> Rectangle, Length
srf = Surface(rectangle.Rectangle)
sph = Sphere(Base="200,200,0", Radius=Slider(50, range=0..100))
rectangle_2 = Rectangle(Plane="-200, -50, 0", XSize=Slider(4, range=0..150), YSize=Slider(4, range=0..120), Radius=0)  # -> Rectangle, Length
sqgrid = Square(Plane=PlaneXY(0, 0, 0), Size=Slider(1.477, range=0..2), ExtentX=Slider(33, range=0..50), ExtentY=Slider(33, range=0..50))  # -> Cells, Points
boxrec = BoxRectangle(Rectangle=rectangle_2.Rectangle, Height=Slider(100, range=0..100))
bbox = BoundingBox(Content=flatten(sqgrid.Points), Plane=PlaneXY(0, 0, 0), UnionBox=True)  # -> Box, Box_2

pt_9 = Point(sqgrid.Points)
dist = Distance(PointA=pt_9, PointB=pt)
dist_2 = Distance(PointA=pt_9, PointB=pt_2)

min = Minimum(A=dist, B=dist_2)

division = Division(A=min, B=Slider(0.5, range=0..1))

pt_10 = Point(sqgrid.Points)
dist_3 = Distance(PointA=pt_10, PointB=pt_3)
dist_4 = Distance(PointA=pt_10, PointB=pt_4)

max = Maximum(A=dist_3, B=dist_4)

division_2 = Division(A=max, B=number_slider)

pt_11 = Point(sqgrid.Points)
dist_5 = Distance(PointA=pt_11, PointB=pt_5)
dist_6 = Distance(PointA=pt_11, PointB=pt_6)

min_2 = Minimum(A=dist_5, B=dist_6)

division_3 = Division(A=min_2, B=Slider(5.865, range=0..20))

pi = Pi(Factor=division_3)

pt_12 = Point(sqgrid.Points)
dist_7 = Distance(PointA=pt_12, PointB=pt_7)
dist_8 = Distance(PointA=pt_12, PointB=pt_8)

max_2 = Maximum(A=dist_7, B=dist_8)

division_4 = Division(A=max_2, B=number_slider_2)

rectangle_3 = Rectangle(Plane=sqgrid.Points, XSize=division_2, YSize=division_4, Radius=0)  # -> Rectangle, Length
rotate = Rotate(Geometry=rectangle_3.Rectangle, Angle=pi, Plane=sqgrid.Points)  # -> Geometry, Transform

# ---- group: 1
# 1: Here you were using the base grid to generate the boundary surface. This meant when you draw rectangles at the grid points, the rectangles will extend past the boundary surface. When you run the map to surface command, the extended geometry has some wierd results (it goes up). When that happened, some of your geometry had surfaces intersecting in the same plane, which was a part of breaking the boolean.
bbox_2 = BoundingBox(Content=flatten(rotate.Geometry), Plane=PlaneXY(0, 0, 0), UnionBox=True)  # -> Box, Box_2
map_srf = MapToSurface(Curve=rotate.Geometry, Source=bbox_2.Box, Target=srf)

# ----
pcen = PolygonCenter(Polyline=map_srf)  # -> CenterV, CenterE, CenterA
srf_cp = SurfaceClosestPoint(Point=pcen.CenterV, Surface=srf)  # -> Point, UVPoint, Distance
evalsrf = EvaluateSurface(Surface=srf, Point=srf_cp.UVPoint)  # -> Point, Normal, Frame
amp = Amplitude(Vector=evalsrf.Normal, Amplitude=division)
extr = Extrude(Base=map_srf, Direction=amp)
capex = CapHolesEx(Brep=extr)  # -> simplify(Brep), Caps, Solid
sunion = SolidUnion(Breps=capex.Brep)
