# Grasshopper definition assignment 03 tutorial 01.gh (Grasshopper 0.9.76)

sqgrid = Square(Plane=PlaneXY(0, 0, 0), Size=1, ExtentX=20, ExtentY=20)  # -> Cells, Points
sqgrid_2 = Square(Plane=PlaneXY(0, 0, 0), Size=1, ExtentX=20, ExtentY=20)  # -> Cells, Points
sqgrid_3 = Square(Plane=PlaneXY(0, 0, 0), Size=1, ExtentX=20, ExtentY=20)  # -> Cells, Points
flatten = FlattenTree(Tree=sqgrid.Points, Path="{0}")
flatten_2 = FlattenTree(Tree=sqgrid_2.Points, Path="{0}")
flatten_3 = FlattenTree(Tree=sqgrid_3.Points, Path="{0}")
# SINGLE POINT ATTRACTOR
pt = Point(<point referenced from the Rhino model>)
pt_2 = Point(<point referenced from the Rhino model>)
# MULTIPLE POINT ATTRACTOR
pt_3 = Point([<point referenced from the Rhino model> x2])
# SINGLE CURVE ATTRACTOR
crv = Curve(<curve referenced from the Rhino model>)

# ---- group: Proximity
number_slider = Slider(20, range=0..20)

number_slider_2 = Slider(20, range=0..20)

# ----
dist = Distance(PointA=pt_2, PointB=flatten)
dist_2 = Distance(PointA=pt, PointB=flatten)
crv_cp = CurveClosestPoint(Point=flatten_3, Curve=crv)  # -> Point, Parameter, Distance
# Graft Points to run a cross referenced process.
dist_3 = Distance(PointA=graft(pt_3), PointB=flatten_2)  # -> simplify(Distance)
remap = RemapNumbers(Value=dist, Source=number_slider, Target=Domain(0, 1))  # -> Mapped, Clipped
remap_2 = RemapNumbers(Value=dist_2, Source=number_slider_2, Target=Domain(0, 1))  # -> Mapped, Clipped
# Flip matrix to compare relative indexes.
flip = FlipMatrix(Data=dist_3)

# ---- group: Falloff
graph = GraphMapper(remap.Clipped, x0=0, x1=1, y0=0, y1=1, container_name="Sine", Equation_px=[0, 0.2013098747], Equation_py=[0, 1])

graph_2 = GraphMapper(remap_2.Clipped, x0=0, x1=1, y0=0, y1=1, container_name="Sine", Equation_px=[0, 1], Equation_py=[0, 1])

# ---- group: Parameter limits
max_effect = Slider(0.5, range=0..20)
min_effect = Slider(0.25, range=0..20)

max_effect_2 = Slider(10.973, range=0..20)
min_effect_2 = Slider(0.25, range=0..20)

# ----
sort = SortList(Keys=flip)  # -> Keys, ValuesA
# Sort and pick out the lowest point
item = ListItem(List=sort.Keys, Index=0, Wrap=True)  # -> flatten(Item)
dom = ConstructDomain(DomainStart=min_effect, DomainEnd=max_effect)
dom_2 = ConstructDomain(DomainStart=min_effect_2, DomainEnd=max_effect_2)

# ---- group: Proximity
number_slider_3 = Slider(20, range=0..20)

number_slider_4 = Slider(20, range=0..20)

# ----
remap_3 = RemapNumbers(Value=graph, Source=Domain(0, 1), Target=dom)  # -> Mapped, Clipped
remap_4 = RemapNumbers(Value=graph_2, Source=Domain(0, 1), Target=dom_2)  # -> Mapped, Clipped
remap_5 = RemapNumbers(Value=item, Source=number_slider_3, Target=Domain(0, 1))  # -> Mapped, Clipped
remap_6 = RemapNumbers(Value=crv_cp.Distance, Source=number_slider_4, Target=Domain(0, 1))  # -> Mapped, Clipped

# ---- group: Falloff
graph_3 = GraphMapper(remap_5.Clipped, x0=0, x1=1, y0=0, y1=1, container_name="Sine", Equation_px=[0, 0.3608699143], Equation_py=[0, 1])

graph_4 = GraphMapper(remap_6.Clipped, x0=0, x1=1, y0=0, y1=1, container_name="Sine", Equation_px=[0, 0.3608699143], Equation_py=[0, 1])

# ---- group: Parameter limits
max_effect_3 = Slider(10.973, range=0..20)
min_effect_3 = Slider(0.25, range=0..20)

max_effect_4 = Slider(10.973, range=0..20)
min_effect_4 = Slider(0.25, range=0..20)

# ----
dom_3 = ConstructDomain(DomainStart=min_effect_3, DomainEnd=max_effect_3)
dom_4 = ConstructDomain(DomainStart=min_effect_4, DomainEnd=max_effect_4)
max_effect_5 = Slider(0.4, range=0..20)
max_effect_6 = Slider(0.4, range=0..20)
remap_7 = RemapNumbers(Value=graph_3, Source=Domain(0, 1), Target=dom_3)  # -> Mapped, Clipped
remap_8 = RemapNumbers(Value=graph_4, Source=Domain(0, 1), Target=dom_4)  # -> Mapped, Clipped
box = CenterBox(Base=flatten, X=remap_3.Mapped, Y=remap_3.Mapped, Z=remap_4.Mapped)
box_2 = CenterBox(Base=flatten_2, X=max_effect_5, Y=max_effect_5, Z=remap_7.Mapped)
box_3 = CenterBox(Base=flatten_3, X=max_effect_6, Y=max_effect_6, Z=remap_8.Mapped)
