# Grasshopper definition assignment 03 tutorial 02.gh (Grasshopper 0.9.76)

md_slider = MDSlider(
    slider_value=Point(0.9774391128, 0.5244514651, 0.5),
    SliderMode=0,
    x_domain=Domain(0, 100),
    y_domain=Domain(0, 100),
    z_domain=Domain(0, 1))
pt = Point(md_slider)
rec = DataRecorder(pt, DataLimit=20, RecordData=True)
lng = ListLength(List=rec)
series = Series(Start=0.1, Step=0.1, Count=lng)
circle = CircleCNR(Center=rec, Normal=Vector(0, 0, 1), Radius=series)
item = ListItem(List=reverse(circle), Index=0, Wrap=True)
item_2 = ListItem(List=circle, Index=0, Wrap=True)
intcrv = Interpolate(Vertices=rec, Degree=3, Periodic=False, KnotStyle=1)  # -> Curve, Length, Domain
shift = ShiftList(List=circle, Shift=-1, Wrap=False)
shift_2 = ShiftList(List=circle, Shift=1, Wrap=False)
tanex = TangentLinesEx(CircleA=shift, CircleB=shift_2)  # -> Tangent1, Tangent2
