# Grasshopper definition assignment 03 tutorial 03.gh (Grasshopper 0.9.76)
# plug-ins: Bifocals

S = Start(1)
series = Series(Start=S, Step=Slider(1, range=0..2), Count=10)
panel = Panel(S)
series_2 = Series(Start=0, Step=1, Count=10)
pt = ConstructPoint(XCoordinate=series_2, YCoordinate=0, ZCoordinate=0)
crv = Curve(<curve referenced from the Rhino model>)
line = LineSDL(Start=pt, Direction=Vector(0, 0, 1), Length=series)
incurve = PointInCurve(Point=pt, Curve=crv)  # -> Relationship, Point
len = Length(Curve=line)
bool = Boolean(incurve.Relationship)
expression = Expression(x=len, y=Slider(3.172, range=0..10), Expression="x≥y")
expression_2 = Expression(x=len, y=Slider(7.953, range=0..10), Expression="x≤y")
panel_2 = Panel(bool)
and = GateAnd(A=expression_2, B=bool)
and_2 = GateAnd(A=expression, B=expression_2)
dispatch = Dispatch(List=line, DispatchPattern=bool)  # -> ListA, ListB
crv_2 = Curve(dispatch.ListB)
crv_3 = Curve(dispatch.ListA)
pipe = Pipe(Curve=crv_2, Radius=0.1, Caps=0)
eval = EvaluateLength(Curve=crv_3, Length=Slider(0.8, range=0..1), Normalized=True)  # -> Point, Tangent, Parameter
xz = XZPlane(Origin=eval.Point)
panel_3 = Panel(expression)
panel_4 = Panel(expression_2)
cir = Circle(Plane=xz, Radius=Slider(0.525, range=0..1))
panel_5 = Panel(len)
