# Grasshopper definition Assignment 04 Tutorial 1.gh (Grasshopper 0.9.76)
# plug-ins: Bifocals

D = Distance(-100)
crv = Curve([<curve referenced from the Rhino model> x4])
panel = Panel(D)
loft = Loft(Curves=crv, Options={Adjust=False, Closed=False, LoftEnds=0, LoftSimp=0, LoftType=0, Rebuild=10, Refit=0.01})
offset = Offset(Surface=loft, Distance=D, Retrim=True)
popgeo = PopulateGeometry(Geometry=loft, Count=100, Seed=1)
xz = XZPlane(Origin=Point(0, 0, 0))
del = DelaunayMesh(Points=popgeo, Plane=xz)
demesh = DeconstructMesh(Mesh=del)  # -> Vertices, Faces, Colours, Normals
lng = ListLength(List=demesh.Vertices)
series = Series(Start=0, Step=1, Count=lng)
deface = DeconstructFace(Face=demesh.Faces)  # -> CornerA, CornerB, CornerC, CornerD
int = Integer(simplify(graft(series)))
expression = Expression(x=int, y=deface.CornerC, Expression="x=y")
expression_2 = Expression(x=int, y=deface.CornerB, Expression="x=y")
expression_3 = Expression(x=int, y=deface.CornerA, Expression="x=y")
srf_cp = SurfaceClosestPoint(Point=demesh.Vertices, Surface=offset)  # -> Point, UVPoint, Distance
points = PointList(Points=demesh.Vertices)
ln = Line(StartPoint=demesh.Vertices, EndPoint=srf_cp.Point)
facen = FaceNormals(Mesh=del)  # -> Centers, Normals
or = GateOr(A=expression_3, B=expression_2, C=expression)
dispatch = Dispatch(List=facen.Centers, DispatchPattern=or)  # -> simplify(ListA), ListB
int_2 = Integer(or)
pt = Point(srf_cp.Point)
pt_2 = Point(demesh.Vertices)
graft = GraftTree(Tree=pt_2, IncludeEmptyLists=True, IncludeNullItems=True)  # -> simplify(Tree)
graft_2 = GraftTree(Tree=pt, IncludeEmptyLists=True, IncludeNullItems=True)  # -> simplify(Tree)
ma = MassAddition(Input=int_2)  # -> Result, PartialResults
ln_2 = Line(StartPoint=graft, EndPoint=dispatch.ListA)
eval = EvaluateLength(Curve=reparameterize(ln_2), Length=Slider(0.411, range=0..1), Normalized=True)  # -> Point, Tangent, Parameter
ln_3 = Line(StartPoint=graft_2, EndPoint=eval.Point)
panel_2 = Panel(dispatch.ListA)
