# Grasshopper definition Assignment 04 Tutorial 2.gh (Grasshopper 0.9.76)
# plug-ins: Bifocals

D = Distance(-200)
crv = Curve([<curve referenced from the Rhino model> x4])
loft = Loft(Curves=crv, Options={Adjust=False, Closed=False, LoftEnds=0, LoftSimp=0, LoftType=0, Rebuild=10, Refit=0.01})
panel = Panel(D)
offset = Offset(Surface=loft, Distance=D, Retrim=True)
popgeo = PopulateGeometry(Geometry=loft, Count=100, Seed=1)
xz = XZPlane(Origin=Point(0, 0, 0))
del = DelaunayMesh(Points=popgeo, Plane=xz)
demesh = DeconstructMesh(Mesh=del)  # -> Vertices, Faces, Colours, Normals
lng = ListLength(List=demesh.Vertices)
deface = DeconstructFace(Face=demesh.Faces)  # -> CornerA, CornerB, CornerC, CornerD
series = Series(Start=0, Step=1, Count=lng)
pt = Point(demesh.Vertices)
int = Integer(simplify(graft(series)))
srf_cp = SurfaceClosestPoint(Point=demesh.Vertices, Surface=offset)  # -> Point, UVPoint, Distance
expression = Expression(x=int, y=deface.CornerC, Expression="x=y")
expression_2 = Expression(x=int, y=deface.CornerB, Expression="x=y")
expression_3 = Expression(x=int, y=deface.CornerA, Expression="x=y")
points = PointList(Points=demesh.Vertices)
facen = FaceNormals(Mesh=del)  # -> Centers, Normals
ln = Line(StartPoint=demesh.Vertices, EndPoint=srf_cp.Point)
or = GateOr(A=expression_3, B=expression_2, C=expression)
pt_2 = Point(demesh.Vertices)
pt_3 = Point(srf_cp.Point)
dispatch = Dispatch(List=facen.Centers, DispatchPattern=or)  # -> simplify(ListA), ListB
dispatch_2 = Dispatch(List=facen.Normals, DispatchPattern=or)  # -> simplify(ListA), ListB
int_2 = Integer(or)
graft = GraftTree(Tree=pt_3, IncludeEmptyLists=True, IncludeNullItems=True)  # -> simplify(Tree)
graft_2 = GraftTree(Tree=pt_2, IncludeEmptyLists=True, IncludeNullItems=True)  # -> simplify(Tree)
ma = MassAddition(Input=int_2)  # -> Result, PartialResults
ln_2 = Line(StartPoint=graft_2, EndPoint=dispatch.ListA)
vec2pt = Vector2Pt(PointA=graft_2, PointB=graft, Unitize=False)  # -> Vector, Length
amp = Amplitude(Vector=dispatch_2.ListA, Amplitude=Slider(50.6, range=0..500))
eval = EvaluateLength(Curve=reparameterize(ln_2), Length=Slider(0.411, range=0..1), Normalized=True)  # -> Point, Tangent, Parameter
pl = PlaneNormal(Origin=graft, ZAxis=vec2pt.Vector)
move = Move(Geometry=eval.Point, Motion=amp)  # -> Geometry, Transform
ln_3 = Line(StartPoint=graft, EndPoint=move.Geometry)
eval_2 = EvaluateLength(Curve=reparameterize(ln_3), Length=Slider(1, range=0..1), Normalized=True)  # -> Point, Tangent, Parameter
pframe = PerpFrame(Curve=ln_3, Parameter=Slider(0, range=0..1))
pframe_2 = PerpFrame(Curve=ln_3, Parameter=Slider(0.679, range=0..1))
pl_2 = PlaneNormal(Origin=eval_2.Point, ZAxis=dispatch_2.ListA)
pl_3 = PlaneNormal(Origin=eval.Point, ZAxis=dispatch_2.ListA)
panel_2 = Panel(graft)
panel_3 = Panel(ln_3)
Z = UnitZ(Factor=1)
align = AlignPlane(Plane=pl_3, Direction=Z)  # -> Plane, Angle
align_2 = AlignPlane(Plane=pframe, Direction=Z)  # -> Plane, Angle
align_3 = AlignPlane(Plane=pl_2, Direction=Z)  # -> Plane, Angle
align_4 = AlignPlane(Plane=pframe_2, Direction=Z)  # -> Plane, Angle
polygon = Polygon(Plane=align.Plane, Radius=Slider(60, range=0..100), Segments=6, FilletRadius=0)  # -> Polygon, Length
polygon_2 = Polygon(Plane=align_2.Plane, Radius=Slider(32.928, range=0..100), Segments=6, FilletRadius=0)  # -> Polygon, Length
polygon_3 = Polygon(Plane=align_3.Plane, Radius=Slider(100, range=0..100), Segments=6, FilletRadius=0)  # -> Polygon, Length
polygon_4 = Polygon(Plane=align_4.Plane, Radius=Slider(32.928, range=0..100), Segments=6, FilletRadius=0)  # -> Polygon, Length
graft_3 = GraftTree(Tree=polygon_2.Polygon, IncludeEmptyLists=True, IncludeNullItems=True)
graft_4 = GraftTree(Tree=polygon_4.Polygon, IncludeEmptyLists=True, IncludeNullItems=True)
graft_5 = GraftTree(Tree=polygon_3.Polygon, IncludeEmptyLists=True, IncludeNullItems=True)
graft_6 = GraftTree(Tree=polygon.Polygon, IncludeEmptyLists=True, IncludeNullItems=True)
number_slider = Slider(100, range=0..100)
number_slider_2 = Slider(100, range=0..100)
panel_4 = Panel("""-x/2
x/2""")
dom = ConstructDomain(DomainStart=expr("-x/2", number_slider_2), DomainEnd=expr("x/2", number_slider_2))
dom_2 = ConstructDomain(DomainStart=expr("-x/2", number_slider), DomainEnd=expr("x/2", number_slider))
dom_3 = ConstructDomain(DomainStart=expr("-x", Slider(43.475, range=0..100)), DomainEnd=Slider(31.627, range=0..100))
loft_2 = Loft(
    Curves=[graft_6, graft_5, graft_4, graft_3],
    Options={Adjust=False, Closed=False, LoftEnds=0, LoftSimp=0, LoftType=3, Rebuild=10, Refit=0.01})
cap = CapHoles(Brep=loft_2)
number_slider_3 = Slider(52, range=0..100)
box = DomainBox(Base=pl, X=dom_2, Y=dom, Z=dom_3)
trim = TrimTree(Tree=cap, Depth=1)
branch = TreeBranch(Tree=box, Path=number_slider_3, MaintainPaths=True)
branch_2 = TreeBranch(Tree=trim, Path=number_slider_3, MaintainPaths=True)
panel_5 = Panel(trim)
