# Grasshopper definition Assignment 04 Tutorial 3.gh (Grasshopper 0.9.76)
# plug-ins: Bifocals

D = Distance(-200)
crv = Curve([<curve referenced from the Rhino model> x4])
loft = Loft(Curves=crv, Options={Adjust=False, Closed=False, LoftEnds=0, LoftSimp=0, LoftType=0, Rebuild=10, Refit=0.01})
offset = Offset(Surface=loft, Distance=D, Retrim=True)
panel = Panel(D)
xz = XZPlane(Origin=Point(0, 0, 0))
popgeo = PopulateGeometry(Geometry=loft, Count=100, Seed=1)
del = DelaunayMesh(Points=popgeo, Plane=xz)
demesh = DeconstructMesh(Mesh=del)  # -> Vertices, Faces, Colours, Normals
lng = ListLength(List=demesh.Vertices)
deface = DeconstructFace(Face=demesh.Faces)  # -> CornerA, CornerB, CornerC, CornerD
series = Series(Start=0, Step=1, Count=lng)
int = Integer(simplify(graft(series)))
panel_2 = Panel(int)
pt = Point(demesh.Vertices)
expression = Expression(x=int, y=deface.CornerC, Expression="x=y")
srf_cp = SurfaceClosestPoint(Point=demesh.Vertices, Surface=offset)  # -> Point, UVPoint, Distance
expression_2 = Expression(x=int, y=deface.CornerB, Expression="x=y")
expression_3 = Expression(x=int, y=deface.CornerA, Expression="x=y")
facen = FaceNormals(Mesh=del)  # -> Centers, Normals
points = PointList(Points=demesh.Vertices)
ln = Line(StartPoint=demesh.Vertices, EndPoint=srf_cp.Point)
or = GateOr(A=expression_3, B=expression_2, C=expression)
pt_2 = Point(demesh.Vertices)
dispatch = Dispatch(List=facen.Centers, DispatchPattern=or)  # -> simplify(ListA), ListB
pt_3 = Point(srf_cp.Point)
int_2 = Integer(or)
graft = GraftTree(Tree=pt_3, IncludeEmptyLists=True, IncludeNullItems=True)  # -> simplify(Tree)
graft_2 = GraftTree(Tree=pt_2, IncludeEmptyLists=True, IncludeNullItems=True)  # -> simplify(Tree)
ma = MassAddition(Input=int_2)  # -> Result, PartialResults
ln_2 = Line(StartPoint=graft_2, EndPoint=dispatch.ListA)
vec2pt = Vector2Pt(PointA=graft_2, PointB=graft, Unitize=False)  # -> Vector, Length
eval = EvaluateLength(Curve=reparameterize(ln_2), Length=Slider(0.294, range=0..1), Normalized=True)  # -> Point, Tangent, Parameter
pl = PlaneNormal(Origin=graft, ZAxis=vec2pt.Vector)
number_slider = Slider(1500, range=0..6000)
number_slider_2 = Slider(1500, range=0..6000)
panel_3 = Panel("""-x/2
x/2""")
dom = ConstructDomain(DomainStart=expr("-x/2", number_slider_2), DomainEnd=expr("x/2", number_slider_2))
dom_2 = ConstructDomain(DomainStart=expr("-x/2", number_slider), DomainEnd=expr("x/2", number_slider))
dom_3 = ConstructDomain(DomainStart=expr("-x", Slider(1500, range=0..6000)), DomainEnd=Slider(100, range=0..100))
faceb = FaceBoundaries(Mesh=del)
box = DomainBox(Base=pl, X=dom_2, Y=dom, Z=dom_3)
panel_4 = Panel(graft)
dispatch_2 = Dispatch(List=faceb, DispatchPattern=or)  # -> simplify(ListA), ListB
number_slider_3 = Slider(42, range=0..100)
branch = TreeBranch(Tree=dispatch_2.ListA, Path=number_slider_3, MaintainPaths=True)
planar = Planar(Curve=branch)  # -> Planar, Plane, Deviation
branch_2 = TreeBranch(Tree=box, Path=number_slider_3, MaintainPaths=True)
offset_2 = Offset(Curve=branch, Distance=expr("-x", Slider(19.612, range=0..100)), Plane=planar.Plane, Corners=1)
boundary = BoundarySurfaces(Edges=offset_2)
split = SplitBrep(Brep=boundary, Cutter=branch_2)
mesh = MeshBrep(
    Brep=split,
    Settings={GridMaxCount=0, GridMinCount=16, JaggedSeams=False, MaxEdgeLength=0, MinEdgeLength=0.0001, MinTolerance=0, Refine=True, RefineAngle=0, RelativeTolerance=0.65, SimplePlanes=True, Tolerance=0})
number_slider_4 = Slider(100, range=0..100)
number_slider_5 = Slider(100, range=0..100)
facen_2 = FaceNormals(Mesh=mesh)  # -> Centers, Normals
item = ListItem(List=facen_2.Centers, Index=0, Wrap=True)
dom_4 = ConstructDomain(DomainStart=expr("-x/2", number_slider_5), DomainEnd=expr("x/2", number_slider_5))
dom_5 = ConstructDomain(DomainStart=expr("-x/2", number_slider_4), DomainEnd=expr("x/2", number_slider_4))
dom_6 = ConstructDomain(DomainStart=expr("-x", Slider(43.475, range=0..100)), DomainEnd=Slider(31.627, range=0..100))
brepinc = PointInBrep(Brep=branch_2, Point=item, Strict=False)  # -> simplify(Inside)
box_2 = DomainBox(Base=pl, X=dom_5, Y=dom_4, Z=dom_6)
trim = TrimTree(Tree=brepinc, Depth=1)
dispatch_3 = Dispatch(List=split, DispatchPattern=trim)  # -> ListA, ListB
geo = Geometry(dispatch_3.ListA)
crv_2 = Curve(flatten(geo))
lng_2 = ListLength(List=crv_2)
planar_2 = Planar(Curve=crv_2)  # -> Planar, Plane, Deviation
series_2 = Series(Start=0, Step=Slider(1918.151, range=0..10000), Count=lng_2)
pt_4 = ConstructPoint(XCoordinate=0, YCoordinate=series_2, ZCoordinate=0)
panel_6 = Panel(trim)
xy = XYPlane(Origin=pt_4)
orient = Orient(Geometry=crv_2, Source=planar_2.Plane, Target=xy)  # -> Geometry, Transform
branch_3 = TreeBranch(Tree=box_2, Path=number_slider_3, MaintainPaths=True)

dispatch_4 = Dispatch(List=facen.Normals, DispatchPattern=or)  # -> simplify(ListA), ListB

amp = Amplitude(Vector=dispatch_4.ListA, Amplitude=Slider(65.6, range=0..500))
move = Move(Geometry=eval.Point, Motion=amp)  # -> Geometry, Transform
ln_3 = Line(StartPoint=graft, EndPoint=move.Geometry)
eval_2 = EvaluateLength(Curve=reparameterize(ln_3), Length=Slider(1, range=0..1), Normalized=True)  # -> Point, Tangent, Parameter
pframe = PerpFrame(Curve=ln_3, Parameter=Slider(0.679, range=0..1))
pframe_2 = PerpFrame(Curve=ln_3, Parameter=Slider(0, range=0..1))
pl_2 = PlaneNormal(Origin=eval.Point, ZAxis=dispatch_4.ListA)
pl_3 = PlaneNormal(Origin=eval_2.Point, ZAxis=dispatch_4.ListA)

vec2pt_2 = Vector2Pt(PointA=pframe_2, PointB=pframe, Unitize=False)  # -> Vector, Length
align = AlignPlane(Plane=pl_3, Direction=vec2pt_2.Vector)  # -> Plane, Angle
align_2 = AlignPlane(Plane=pl_2, Direction=vec2pt_2.Vector)  # -> Plane, Angle

panel_7 = Panel(ln_3)

align_3 = AlignPlane(Plane=pframe, Direction=dispatch_4.ListA)  # -> Plane, Angle
align_4 = AlignPlane(Plane=pframe_2, Direction=dispatch_4.ListA)  # -> Plane, Angle

polygon = Polygon(Plane=align_2.Plane, Radius=Slider(60, range=0..100), Segments=6, FilletRadius=0)  # -> Polygon, Length
polygon_2 = Polygon(Plane=align_4.Plane, Radius=Slider(32.928, range=0..100), Segments=6, FilletRadius=0)  # -> Polygon, Length
polygon_3 = Polygon(Plane=align.Plane, Radius=Slider(100, range=0..100), Segments=6, FilletRadius=0)  # -> Polygon, Length
polygon_4 = Polygon(Plane=align_3.Plane, Radius=Slider(32.928, range=0..100), Segments=6, FilletRadius=0)  # -> Polygon, Length
branch_4 = TreeBranch(Tree=polygon.Polygon, Path=number_slider_3, MaintainPaths=True)
branch_5 = TreeBranch(Tree=polygon_3.Polygon, Path=number_slider_3, MaintainPaths=True)
branch_6 = TreeBranch(Tree=polygon_2.Polygon, Path=number_slider_3, MaintainPaths=True)
branch_7 = TreeBranch(Tree=polygon_4.Polygon, Path=number_slider_3, MaintainPaths=True)
graft_3 = GraftTree(Tree=branch_6, IncludeEmptyLists=True, IncludeNullItems=True)
graft_4 = GraftTree(Tree=branch_7, IncludeEmptyLists=True, IncludeNullItems=True)
graft_5 = GraftTree(Tree=branch_4, IncludeEmptyLists=True, IncludeNullItems=True)
graft_6 = GraftTree(Tree=branch_5, IncludeEmptyLists=True, IncludeNullItems=True)
flip = FlipCurve(Curve=graft_3)  # -> Curve, Flag
flip_2 = FlipCurve(Curve=graft_4)  # -> Curve, Flag
branch_8 = TreeBranch(Tree=polygon.Polygon, Path=number_slider_3, MaintainPaths=True)
loft_2 = Loft(
    Curves=[graft_5, graft_6, flip_2.Curve, flip.Curve],
    Options={Adjust=False, Closed=False, LoftEnds=0, LoftSimp=0, LoftType=3, Rebuild=10, Refit=0.01})
cap = CapHoles(Brep=loft_2)
orient_2 = Orient(Geometry=branch_8, Source=planar_2.Plane, Target=xy)  # -> Geometry, Transform
trim_2 = TrimTree(Tree=cap, Depth=1)
