# Grasshopper definition CA002 - AB Comments.gh (Grasshopper 0.9.76)

pt = ConstructPoint(XCoordinate=Slider(0, range=-50..50), YCoordinate=Slider(0, range=0..100), ZCoordinate=0)
pt_2 = ConstructPoint(XCoordinate=Slider(0, range=-50..50), YCoordinate=Slider(7, range=0..100), ZCoordinate=0)
pt_3 = ConstructPoint(XCoordinate=Slider(3, range=-50..50), YCoordinate=Slider(3, range=0..100), ZCoordinate=0)
pt_4 = ConstructPoint(XCoordinate=Slider(-4, range=-50..100), YCoordinate=Slider(3, range=0..100), ZCoordinate=0)
avr = Average(Input=[pt, pt_2, pt_3, pt_4])
voronoi = Voronoi(Points=[pt, pt_4, pt_2, pt_3], Radius=Slider(4, range=0..100), BruteForceOverride=False)
explode = Explode(Curve=voronoi, Recursive=True)  # -> Segments, Vertices
cp = ClosestPoint(Point=avr, Cloud=explode.Vertices)  # -> ClosestPoint, CPIndex, Distance
item = ListItem(List=explode.Vertices, Index=cp.CPIndex, Wrap=True)  # -> Item1, Item, Item1_2

Z = UnitZ(Factor=expr("-x", Slider(1.4, range=0..5)))
move = Move(Geometry=item.Item, Motion=Z)  # -> Geometry, Transform

pt_5 = Point(item.Item1_2)
Z_2 = UnitZ(Factor=expr("-x", Slider(5, range=0..5)))
Z_3 = UnitZ(Factor=1)
pl_3pt = Plane3Pt(PointA=move.Geometry, PointB=item.Item1, PointC=pt_5)
move_2 = Move(Geometry=move.Geometry, Motion=Z_2)  # -> Geometry, Transform
cone = Cone(Base=move_2.Geometry, Radius=Slider(4, range=0..10), Length=Slider(3, range=0..10))  # -> Cone, Tip
projecta = ProjectAlong(Geometry=voronoi, Plane=flatten(pl_3pt), Direction=Z_3)  # -> Geometry, Transform
debrep = DeconstructBrep(Brep=cone.Cone)  # -> Faces, Edges, Vertices
pt_6 = Point(move.Geometry)
Z_4 = UnitZ(Factor=Slider(2, range=0..10, expression="-x"))
move_3 = Move(Geometry=pt_6, Motion=Z_4)  # -> Geometry, Transform
ln = Line(StartPoint=move.Geometry, EndPoint=move_3.Geometry)
end = EndPoints(Curve=ln)  # -> Start, End
boundary = BoundarySurfaces(Edges=projecta.Geometry)
area = Area(Geometry=boundary)  # -> Area, Centroid
pt_7 = Point(end.End)
ln_2 = Line(StartPoint=pt_7, EndPoint=area.Centroid)
Z_5 = UnitZ(Factor=Slider(0.499, range=0..1))
move_4 = Move(Geometry=pt_7, Motion=Z_5)  # -> Geometry, Transform
offset = Offset(Curve=boundary, Distance=Slider(-0.182, range=-10..1), Plane=PlaneXY(0, 0, 0), Corners=1)
Z_6 = UnitZ(Factor=Slider(0, range=0..10, expression="-x"))
debrep_2 = DeconstructBrep(Brep=offset)  # -> Faces, Edges, Vertices
area_2 = Area(Geometry=boundary)  # -> Area, Centroid
cat = Catenary(PointA=pt_7, PointB=area_2.Centroid, Length=Slider(7, range=0..10), Gravity=Z_6)
offset_2 = Offset(Curve=boundary, Distance=Slider(-0.636, range=-10..1), Plane=PlaneXY(0, 0, 0), Corners=1)
sph = Sphere(Base=pt_7, Radius=Slider(0.704, range=0..1))
box = CenterBox(Base=move_4.Geometry, X=Slider(0.377, range=0..1), Y=Slider(0.378, range=0..1), Z=Slider(0.227, range=0..1))
offset_3 = Offset(Curve=boundary, Distance=Slider(-0.8, range=-10..1), Plane=PlaneXY(0, 0, 0), Corners=1)
debrep_3 = DeconstructBrep(Brep=offset_2)  # -> Faces, Edges, Vertices
sdiff = SolidDifference(BrepsA=sph, BrepsB=box)
debrep_4 = DeconstructBrep(Brep=offset_3)  # -> Faces, Edges, Vertices
padjust = AdjustPlane(Plane=area_2.Centroid, Normal=debrep_4.Faces)
sdiff_2 = SolidDifference(BrepsA=debrep_2.Faces, BrepsB=debrep_3.Faces)
divide = DivideCurve(Curve=cat, Count=Slider(2, range=0..5), Kinks=False)  # -> Points, Tangents, Parameters
divide_2 = DivideCurve(Curve=debrep_4.Edges, Count=Slider(2, range=0..5), Kinks=False)  # -> Points, Tangents, Parameters
debrep_5 = DeconstructBrep(Brep=sdiff_2)  # -> Faces, Edges, Vertices
cull_i = CullIndex(List=reverse(divide.Points), Indices=0, Wrap=True)
crv = Curve(debrep_4.Edges)
Z_7 = UnitZ(Factor=Slider(0, range=0..10, expression="-x"))
cull_i_2 = CullIndex(List=reverse(divide_2.Points), Indices=0, Wrap=True)
cull_i_3 = CullIndex(List=reverse(cull_i), Indices=0, Wrap=True)  # -> simplify(List)
cull_i_4 = CullIndex(List=reverse(cull_i_2), Indices=0, Wrap=True)  # -> simplify(List)
cat_2 = Catenary(PointA=pt_7, PointB=cull_i_3, Length=Slider(3.488, range=0..10), Gravity=Z_7)
vpipe = PipeVariable(Curve=cat_2, Parameters=Slider(0.115, range=0..1), Radii=Slider(0.7, range=0..1), Caps=1)
debrep_6 = DeconstructBrep(Brep=[debrep_5.Faces, debrep_4.Faces])  # -> Faces, Edges, Vertices
cap = CapHoles(Brep=vpipe)

geo = Geometry(debrep_4.Faces)
series = Series(Start=0, Step=Slider(100, range=0..100), Count=debrep_6.Faces)
series_2 = Series(Start=0, Step=Slider(100, range=0..100), Count=geo)
pt_8 = ConstructPoint(XCoordinate=series, YCoordinate=0, ZCoordinate=0)
pt_9 = ConstructPoint(XCoordinate=0, YCoordinate=series_2, ZCoordinate=0)
xy = XYPlane(Origin=pt_8)
xy_2 = XYPlane(Origin=pt_9)
orient = Orient(Geometry=debrep_6.Faces, Source=PlaneXY(0, 0, 0), Target=xy)  # -> Geometry, Transform
orient_2 = Orient(Geometry=geo, Source=PlaneXY(0, 0, 0), Target=xy_2)  # -> Geometry, Transform

brep = Brep(cap)

trim = TrimTree(Tree=cull_i_4, Depth=1)
crv_cp = CurveClosestPoint(Point=trim, Curve=offset_2)  # -> Point, Parameter, Distance

ln_3 = Line(StartPoint=trim, EndPoint=crv_cp.Point)

# ---- group: Panel Alignment
evalsrf = EvaluateSurface(Surface=reparameterize(boundary), Point=Point(0.5, 0.5, 0))  # -> Point, Normal, Frame
lng = ListLength(List=evalsrf.Frame)
series_3 = Series(Start=0, Step=Slider(8.61, range=0..100), Count=lng)
pt_10 = ConstructPoint(XCoordinate=0, YCoordinate=series_3, ZCoordinate=0)
xy_3 = XYPlane(Origin=pt_10)
orient_3 = Orient(Geometry=flatten(debrep_4.Faces), Source=evalsrf.Frame, Target=xy_3)  # -> Geometry, Transform
orient_4 = Orient(Geometry=flatten(debrep_5.Faces), Source=evalsrf.Frame, Target=xy_3)  # -> Geometry, Transform
