# Grasshopper definition MT004 - AB Comments.gh (Grasshopper 0.9.76)

number_slider = Slider(150, range=0..200)
crv = Curve([<curve referenced from the Rhino model> x6])
loft = Loft(Curves=crv, Options={Adjust=False, Closed=False, LoftEnds=0, LoftSimp=0, LoftType=0, Rebuild=10, Refit=0.01})
srf = Surface(loft)
crv_2 = Curve(srf)
popgeo = PopulateGeometry(Geometry=crv_2, Count=Slider(24, range=0..100), Seed=1)
popgeo_2 = PopulateGeometry(Geometry=loft, Count=number_slider, Seed=1)
popgeo_3 = PopulateGeometry(Geometry=loft, Count=number_slider, Seed=1)
xz = XZPlane(Origin=Point(0, 0, 0))
# offset surface to define inside and outside
# create a line between the point on the mesh and the corresponding point on the offset surface. currently the line is connected mesh to offset surface (which may end up mattering)
offset = Offset(Surface=loft, Distance=Slider(150, range=0..500), Retrim=True)
del = DelaunayMesh(Points=[popgeo_2, popgeo], Plane=xz)
demesh = DeconstructMesh(Mesh=del)  # -> Vertices, Faces, Colours, Normals

# ---- group: Shows the points number on the mesh (currently very small
points = PointList(Points=demesh.Vertices, Size=Slider(67, range=0..100))

# ---- group: Find Vertex Point on Offset Surface
srf_cp = SurfaceClosestPoint(Point=demesh.Vertices, Surface=offset)  # -> Point, UVPoint, Distance

# ---- group: Line between surfaces
ln = Line(StartPoint=demesh.Vertices, EndPoint=srf_cp.Point)

# ---- group: Create Shape at end of line between surfaces
distance_from_panelled_srf = Slider(1, range=0..1)
pframe = PerpFrame(Curve=ln, Parameter=distance_from_panelled_srf)
polygon = Polygon(Plane=pframe, Radius=Slider(30, range=0..50), Segments=Slider(6, range=0..10), FilletRadius=0)  # -> Polygon, Length

# ----
# create a list with the vertex number in it. Test if this number corresponds to the corner of a face, if yes then assign a true value
# have a bunch of polygons that don't have a relationship to vertices, need to convert polygon list in to a format that relates to our vertex. deconstruct face, to give the three indexs, which can be tested against our vertexs
lng = ListLength(List=demesh.Vertices)
series = Series(Start=0, Step=1, Count=lng)
int = Integer(simplify(graft(series)))

# ----
# breaks down the edges of the polygon, (returns the index of the vertix it is connected too)
deface = DeconstructFace(Face=demesh.Faces)  # -> CornerA, CornerB, CornerC, CornerD

# ---- group: center of panel
facen = FaceNormals(Mesh=del)  # -> Centers, Normals

# ----
expression = Expression(x=int, y=deface.CornerA, Expression="x=y")
expression_2 = Expression(x=int, y=deface.CornerB, Expression="x=y")
# graft the interger list, so I have a branch for every vertices, we can then test each branch against every number in the already flat list of faces vertices
expression_3 = Expression(x=int, y=deface.CornerC, Expression="x=y")
or = GateOr(A=expression, B=expression_2, C=expression_3)

# ----
# Counts the number of panels each vertex is associated with
int_2 = Integer(or)
ma = MassAddition(Input=int_2)  # -> Result, PartialResults
panel = Panel(ma.Result)

# ---- group: Vertexs as Tree
pt = Point(demesh.Vertices)
graft = GraftTree(Tree=pt, IncludeEmptyLists=True, IncludeNullItems=True)  # -> simplify(Tree)

# ---- group: Points on Offset Srf
pt_2 = Point(srf_cp.Point)
graft_2 = GraftTree(Tree=pt_2, IncludeEmptyLists=True, IncludeNullItems=True)  # -> simplify(Tree)

# ---- group: Dispatch Normals of each panel
dispatch = Dispatch(List=facen.Normals, DispatchPattern=or)  # -> simplify(ListA), ListB

# ---- group: Dispatch center point of each panel
dispatch_2 = Dispatch(List=facen.Centers, DispatchPattern=or)  # -> simplify(ListA), ListB

# ---- group: Connect center and vertex
ln_2 = Line(StartPoint=dispatch_2.ListA, EndPoint=graft)

# ---- group: Distance from Panel Corner clamp attachs
eval = EvaluateLength(Curve=reparameterize(ln_2), Length=Slider(0.85, range=0..1), Normalized=True)  # -> Point, Tangent, Parameter

# ---- group: Lift Point off the panelled surface
amp = Amplitude(Vector=dispatch.ListA, Amplitude=Slider(3, range=0..5))
rev = Reverse(Vector=amp)
move = Move(Geometry=eval.Point, Motion=rev)  # -> Geometry, Transform

# ---- group: Main line of Clamp
ln_3 = Line(StartPoint=graft_2, EndPoint=eval.Point)

# ---- group: WHY DID WE DO THIS??
pframe_2 = PerpFrame(Curve=reparameterize(ln_3), Parameter=Slider(0.8, range=0..1))
pframe_3 = PerpFrame(Curve=reparameterize(ln_3), Parameter=Slider(0, range=0..1))
vec2pt = Vector2Pt(PointA=pframe_2, PointB=pframe_3, Unitize=False)  # -> Vector, Length

# ---- group: Point on line between surfaces
eval_2 = EvaluateLength(Curve=reparameterize(ln_3), Length=Slider(1, range=0..1), Normalized=True)  # -> Point, Tangent, Parameter

# ---- group: O is Location, Z is Normal to the panel
pl = PlaneNormal(Origin=eval.Point, ZAxis=dispatch.ListA)
pl_2 = PlaneNormal(Origin=eval_2.Point, ZAxis=dispatch.ListA)

# ----
number_slider_2 = Slider(139, range=0..150)

# ---- group: Vector to offset surface and a plane at that point
vec2pt_2 = Vector2Pt(PointA=graft_2, PointB=graft, Unitize=False)  # -> Vector, Length
pl_3 = PlaneNormal(Origin=graft_2, ZAxis=vec2pt_2.Vector)

# ---- group: Create a bounding box to trim geometry
number_slider_3 = Slider(300, range=0..408)
number_slider_4 = Slider(300, range=0..300)
dom = ConstructDomain(DomainStart=expr("-x/2", Slider(0, range=0..100)), DomainEnd=expr("x/2", Slider(500, range=0..500)))
dom_2 = ConstructDomain(DomainStart=expr("-x/2", number_slider_3), DomainEnd=expr("x/2", number_slider_3))
dom_3 = ConstructDomain(DomainStart=expr("-x/2", number_slider_4), DomainEnd=expr("x/2", number_slider_4))
box = DomainBox(Base=pl_3, X=dom_2, Y=dom_3, Z=dom)
branch = TreeBranch(Tree=box, Path=number_slider_2, MaintainPaths=True)

# ----
circle = CircleCNR(Center=eval.Point, Normal=dispatch.ListA, Radius=Slider(7.5, range=0..30))
circle_2 = CircleCNR(Center=move.Geometry, Normal=dispatch.ListA, Radius=Slider(7.5, range=0..30))

# ---- group: Number of Sides
number_slider_5 = Slider(6, range=0..10)

# ----
align = AlignPlane(Plane=pl_2, Direction=vec2pt.Vector)  # -> Plane, Angle
align_2 = AlignPlane(Plane=pl, Direction=vec2pt.Vector)  # -> Plane, Angle
align_3 = AlignPlane(Plane=pframe_2, Direction=dispatch.ListA)  # -> Plane, Angle
branch_2 = TreeBranch(Tree=circle_2, Path=number_slider_2, MaintainPaths=True)
branch_3 = TreeBranch(Tree=ln_3, Path=number_slider_2, MaintainPaths=True)
align_4 = AlignPlane(Plane=pframe_3, Direction=dispatch.ListA)  # -> Plane, Angle
branch_4 = TreeBranch(Tree=circle, Path=number_slider_2, MaintainPaths=True)
number_slider_6 = Slider(98, range=0..100)
graft_3 = GraftTree(Tree=branch_4, IncludeEmptyLists=True, IncludeNullItems=True)
graft_4 = GraftTree(Tree=branch_2, IncludeEmptyLists=True, IncludeNullItems=True)
graft_5 = GraftTree(Tree=branch_3, IncludeEmptyLists=True, IncludeNullItems=True)

# ---- group: Poly on Surface
polygon_2 = Polygon(Plane=align_2.Plane, Radius=Slider(10, range=0..10), Segments=number_slider_5, FilletRadius=0)  # -> Polygon, Length

# ---- group: Poly Parallel to Panel
polygon_3 = Polygon(Plane=align.Plane, Radius=Slider(6, range=0..10), Segments=number_slider_5, FilletRadius=0)  # -> Polygon, Length

# ---- group: Poly Oriented along line
polygon_4 = Polygon(Plane=align_3.Plane, Radius=Slider(9, range=0..10), Segments=number_slider_5, FilletRadius=0)  # -> Polygon, Length
polygon_5 = Polygon(Plane=align_4.Plane, Radius=Slider(10, range=0..10), Segments=number_slider_5, FilletRadius=0)  # -> Polygon, Length

# ----
pipe = Pipe(Curve=graft_5, Radius=Slider(6, range=0..10), Caps=0)
loft_2 = Loft(
    Curves=[graft_3, graft_4],
    Options={Adjust=False, Closed=False, LoftEnds=0, LoftSimp=0, LoftType=0, Rebuild=10, Refit=0.01})
cap = CapHoles(Brep=loft_2)
branch_5 = TreeBranch(Tree=polygon_2.Polygon, Path=number_slider_6, MaintainPaths=True)
branch_6 = TreeBranch(Tree=polygon_3.Polygon, Path=number_slider_6, MaintainPaths=True)
branch_7 = TreeBranch(Tree=polygon_4.Polygon, Path=number_slider_6, MaintainPaths=True)
branch_8 = TreeBranch(Tree=polygon_5.Polygon, Path=number_slider_6, MaintainPaths=True)
graft_6 = GraftTree(Tree=branch_5, IncludeEmptyLists=True, IncludeNullItems=True)
graft_7 = GraftTree(Tree=branch_6, IncludeEmptyLists=True, IncludeNullItems=True)
graft_8 = GraftTree(Tree=branch_8, IncludeEmptyLists=True, IncludeNullItems=True)
graft_9 = GraftTree(Tree=branch_7, IncludeEmptyLists=True, IncludeNullItems=True)
faceb = FaceBoundaries(Mesh=del)

# ---- group: Shape the Curves
number_slider_7 = Slider(0.444, range=0..1)
number_slider_8 = Slider(1, range=0..1)
number_slider_9 = Slider(0.074, range=0..1)
number_slider_10 = Slider(0, range=0..1)
number_slider_11 = Slider(0.725, range=0..1)
number_slider_12 = Slider(1, range=0..1)
number_slider_13 = Slider(0.332, range=0..1)
number_slider_14 = Slider(0, range=0..1)

# ----
pln = Plane(simplify(graft(pframe)))

# ---- group: without alignment, very cool
loft_3 = Loft(
    Curves=[graft_6, graft_7, graft_9, graft_8],
    Options={Adjust=False, Closed=False, LoftEnds=0, LoftSimp=0, LoftType=3, Rebuild=10, Refit=0.01})

# ----
crv_3 = Curve(ln_3)
# dispatch the faces associated with the branch number
dispatch_3 = Dispatch(List=faceb, DispatchPattern=or)  # -> simplify(ListA), ListB
lng_2 = ListLength(List=crv_3)
branch_9 = TreeBranch(Tree=dispatch_3.ListA, Path=number_slider_2, MaintainPaths=True)
eval_3 = EvaluateCurve(Curve=reparameterize(graft(crv_3)), Parameter=[number_slider_10, number_slider_9, number_slider_7, number_slider_8])  # -> simplify(Point), Tangent, Angle
eval_4 = EvaluateCurve(Curve=reparameterize(graft(crv_3)), Parameter=[number_slider_14, number_slider_13, number_slider_11, number_slider_12])  # -> simplify(Point), Tangent, Angle
repeat = RepeatData(Data=pln, Length=lng_2)  # -> simplify(Data)
cir = Circle(Plane=pln, Radius=10)
project = Project(Geometry=crv_3, Plane=pln)  # -> Geometry, Transform
planar = Planar(Curve=branch_9)  # -> Planar, Plane, Deviation
graft_10 = GraftTree(Tree=repeat, IncludeEmptyLists=True, IncludeNullItems=True)
ccx = CurveCurve(CurveA=project.Geometry, CurveB=cir)  # -> Points, ParamsA, ParamsB
pl_origin = PlaneOrigin(Base=graft_10, Origin=eval_3.Point)
trim = TrimTree(Tree=ccx.ParamsB, Depth=1)
project_2 = Project(Geometry=eval_4.Point, Plane=pl_origin)  # -> Geometry, Transform
# offset the panels at this step before boundary surface if the panels are going to overlap (convex joint)
offset_2 = Offset(Curve=branch_9, Distance=expr("-x", Slider(5, range=0..10)), Plane=planar.Plane, Corners=1)

# ---- group: How do I get rid of this
eval_5 = EvaluateLength(Curve=reparameterize(ln_3), Length=Slider(0.5, range=0..1), Normalized=True)  # -> Point, Tangent, Parameter
pt_3 = Point(eval_5.Point)
fcircle = CircleFit(Points=eval_5.Point)  # -> Circle, Radius, Deviation
crv_cp = CurveClosestPoint(Point=pt_3, Curve=reparameterize(fcircle.Circle))  # -> Point, Parameter, Distance

# ----
shatter = Shatter(Curve=cir, Parameters=trim)
intcrv = Interpolate(Vertices=project_2.Geometry, Degree=3, Periodic=False, KnotStyle=1)  # -> Curve, Length, Domain

# ---- group: make panels into surface
boundary = BoundarySurfaces(Edges=offset_2)

# ----
eval_6 = EvaluateCurve(Curve=reparameterize(shatter), Parameter=0.5)  # -> Point, Tangent, Angle
deplane = DeconstructPlane(Plane=pln)  # -> Origin, XAxis, YAxis, ZAxis
trim_2 = TrimTree(Tree=intcrv.Curve, Depth=1)
sort = SortList(Keys=crv_cp.Parameter, ValuesA=trim_2)  # -> Keys, ValuesA
vec2pt_3 = Vector2Pt(PointA=deplane.Origin, PointB=eval_6.Point, Unitize=False)  # -> Vector, Length
pl_4 = ConstructPlane(Origin=deplane.Origin, XAxis=vec2pt_3.Vector, YAxis=deplane.ZAxis)  # -> simplify(Plane)

# ---- group: Curve to Trim at Panel
branch_10 = TreeBranch(Tree=sort.ValuesA, Path=number_slider_2, MaintainPaths=True)

# ----
branch_11 = TreeBranch(Tree=pl_4, Path=number_slider_2, MaintainPaths=True)

# ---- group: Extend Curve Past Glass
l0 = Start(100)
ext = ExtendCurve(Curve=branch_10, Type=2, Start=0, End=l0)

# ----
planesrf = PlaneSurface(Plane=branch_11, XSize=Domain(0, 1000), YSize=Domain(-1000, 1000))
loft_4 = Loft(Curves=branch_10, Options={Adjust=False, Closed=True, LoftEnds=0, LoftSimp=0, LoftType=0, Rebuild=10, Refit=0.01})

# ---- group: Cut the panes so they fit in the box
split = SplitBrep(Brep=boundary, Cutter=branch)
mesh = MeshBrep(
    Brep=split,
    Settings={GridMaxCount=0, GridMinCount=16, JaggedSeams=False, MaxEdgeLength=0, MinEdgeLength=0.0001, MinTolerance=0, Refine=True, RefineAngle=0, RelativeTolerance=0.65, SimplePlanes=True, Tolerance=0})
facen_2 = FaceNormals(Mesh=mesh)  # -> Centers, Normals
item = ListItem(List=facen_2.Centers, Index=0, Wrap=True)
brepinc = PointInBrep(Brep=branch, Point=item, Strict=False)  # -> simplify(Inside)
trim_3 = TrimTree(Tree=brepinc, Depth=1)
dispatch_4 = Dispatch(List=split, DispatchPattern=trim_3)  # -> ListA, ListB
geo = Geometry(dispatch_4.ListA)
crv_4 = Curve(flatten(geo))

# ---- group: Curve to Trim on top half
bbx = BrepBrep(BrepA=loft_4, BrepB=planesrf)  # -> Curves, Points

# ----
eval_7 = EvaluateLength(Curve=reparameterize(branch_10), Length=Slider(0.63, range=0..1), Normalized=True)  # -> Point, Tangent, Parameter
lng_3 = ListLength(List=branch_9)
pt_4 = Point(eval_7.Point)
series_2 = Series(Start=0, Step=Slider(200, range=0..200), Count=lng_3)
fcircle_2 = CircleFit(Points=pt_4)  # -> Circle, Radius, Deviation
pt_5 = ConstructPoint(XCoordinate=series_2, YCoordinate=0, ZCoordinate=0)
crv_cp_2 = CurveClosestPoint(Point=pt_4, Curve=reparameterize(fcircle_2.Circle))  # -> Point, Parameter, Distance
xy = XYPlane(Origin=pt_5)

# ---- group: Polyline based on the top hinges
pline = PolyLine(Vertices=crv_cp_2.Point, Closed=True)

# ----
offset_3 = Offset(Curve=pline, Distance=expr("-x", Slider(20, range=0..100)), Plane=PlaneXY(0, 0, 0), Corners=3)
srf_2 = Surface(offset_3)
scx = SurfaceCurve(Surface=srf_2, Curve=[bbx.Curves, branch_10])  # -> Curves, Points, UVPoints, Normals, Parameters, Tangents
pt_6 = Point(flatten(scx.Points))
planar_2 = Planar(Curve=crv_4)  # -> Planar, Plane, Deviation

# ---- group: Orient pad on surface
branch_12 = TreeBranch(Tree=circle, Path=number_slider_2, MaintainPaths=True)
orient = Orient(Geometry=branch_12, Source=planar_2.Plane, Target=xy)  # -> Geometry, Transform

# ----
fcircle_3 = CircleFit(Points=pt_6)  # -> Circle, Radius, Deviation
crv_cp_3 = CurveClosestPoint(Point=pt_6, Curve=reparameterize(fcircle_3.Circle))  # -> Point, Parameter, Distance
orient_2 = Orient(Geometry=crv_4, Source=planar_2.Plane, Target=xy)  # -> Geometry, Transform
sort_2 = SortList(Keys=crv_cp_3.Parameter, ValuesA=crv_cp_3.Point)  # -> Keys, ValuesA

# ---- group: Polyline based on all the lines intersections
pline_2 = PolyLine(Vertices=sort_2.ValuesA, Closed=True)

# ----
offset_4 = Offset(Curve=pline_2, Distance=expr("-x", Slider(28, range=0..100)), Plane=PlaneXY(0, 0, 0), Corners=3)
srf_3 = Surface(offset_4)
brep = Brep(srf_3)
area = Area(Geometry=srf_3)  # -> Area, Centroid
split_2 = SplitWithBrep(Curve=bbx.Curves, Brep=brep)  # -> Curve, Points
split_3 = SplitWithBrep(Curve=branch_10, Brep=brep)  # -> Curve, Points
simplify = SimplifyTree(Tree=split_2.Curve, Front=False)
evalsrf = EvaluateSurface(Surface=srf_3, Point=area.Centroid)  # -> Point, Normal, Frame
dispatch_5 = Dispatch(List=simplify, DispatchPattern=[True, False])  # -> ListA, ListB
simplify_2 = SimplifyTree(Tree=split_3.Curve, Front=False)
dispatch_6 = Dispatch(List=simplify_2, DispatchPattern=[True, False])  # -> ListA, ListB
branch_13 = TreeBranch(Tree=dispatch.ListA, Path=number_slider_2, MaintainPaths=True)
crv_5 = Curve(dispatch_6.ListA)
crv_6 = Curve(dispatch_6.ListB)
graft_11 = GraftTree(Tree=branch_13, IncludeEmptyLists=True, IncludeNullItems=True)

# ---- group: Distance Along Line
number_slider_15 = Slider(0.3, range=0..1)

# ---- group: Glass Thickness
number_slider_16 = Slider(3, range=0..10)

# ----
number_slider_17 = Slider(7.5, range=0..10)

flip = FlipCurve(Curve=dispatch_5.ListA)  # -> Curve, Flag
pframe_4 = PerpFrame(Curve=reparameterize(flip.Curve), Parameter=number_slider_15)
eval_8 = EvaluateLength(Curve=flip.Curve, Length=number_slider_16, Normalized=False)  # -> Point, Tangent, Parameter
pframe_5 = PerpFrame(Curve=reparameterize(flip.Curve), Parameter=Slider(0, range=0..1))
pframe_6 = PerpFrame(Curve=reparameterize(flip.Curve), Parameter=Slider(0.5, range=0..1))
vec2pt_4 = Vector2Pt(PointA=pframe_5, PointB=pframe_6, Unitize=False)  # -> Vector, Length
pl_5 = PlaneNormal(Origin=eval_8.Point, ZAxis=evalsrf.Normal)
align_5 = AlignPlane(Plane=pframe_4, Direction=evalsrf.Normal)  # -> Plane, Angle
align_6 = AlignPlane(Plane=pl_5, Direction=vec2pt_4.Vector)  # -> Plane, Angle
cir_2 = Circle(Plane=align_6.Plane, Radius=number_slider_17)
cir_3 = Circle(Plane=align_5.Plane, Radius=number_slider_17)
rotate = Rotate(Geometry=cir_2, Angle=degrees(Slider(180, range=0..180)), Plane=align_6.Plane)  # -> Geometry, Transform
loft_5 = Loft(
    Curves=[cir_3, rotate.Geometry],
    Options={Adjust=False, Closed=False, LoftEnds=0, LoftSimp=0, LoftType=0, Rebuild=10, Refit=0.01})

# ---- group: Main Body
flip_2 = FlipCurve(Curve=dispatch_5.ListB)  # -> Curve, Flag
series_3 = Series(Start=0, Step=Slider(0.1, range=0..0.1), Count=10)
eval_9 = EvaluateLength(Curve=reparameterize(flip_2.Curve), Length=Slider(1, range=0..1), Normalized=True)  # -> Point, Tangent, Parameter
eval_10 = EvaluateLength(Curve=reparameterize(flip_2.Curve), Length=series_3, Normalized=True)  # -> Point, Tangent, Parameter
pframe_7 = PerpFrame(Curve=reparameterize(flip_2.Curve), Parameter=Slider(0, range=0..1))
pframe_8 = PerpFrame(Curve=reparameterize(flip_2.Curve), Parameter=Slider(0.5, range=0..1))
pframe_9 = PerpFrame(Curve=reparameterize(flip_2.Curve), Parameter=eval_10.Parameter)
vec2pt_5 = Vector2Pt(PointA=pframe_7, PointB=pframe_8, Unitize=False)  # -> Vector, Length
pl_6 = PlaneNormal(Origin=eval_9.Point, ZAxis=evalsrf.Normal)
align_7 = AlignPlane(Plane=pframe_9, Direction=evalsrf.Normal)  # -> Plane, Angle
align_8 = AlignPlane(Plane=pl_6, Direction=vec2pt_5.Vector)  # -> Plane, Angle
cir_4 = Circle(Plane=align_7.Plane, Radius=number_slider_17)
cir_5 = Circle(Plane=align_8.Plane, Radius=number_slider_17)
flip_3 = FlipCurve(Curve=cir_5)  # -> Curve, Flag
rotate_2 = Rotate(Geometry=cir_5, Angle=degrees(Slider(180, range=0..180)), Plane=align_8.Plane)  # -> Geometry, Transform
loft_6 = Loft(
    Curves=[cir_4, rotate_2.Geometry],
    Options={Adjust=False, Closed=False, LoftEnds=0, LoftSimp=0, LoftType=0, Rebuild=10, Refit=0.01})

# ----
flip_4 = FlipCurve(Curve=crv_6)  # -> Curve, Flag

flip_5 = FlipCurve(Curve=crv_5)  # -> Curve, Flag
pframe_10 = PerpFrame(Curve=reparameterize(flip_5.Curve), Parameter=Slider(0.2, range=0..1))
eval_11 = EvaluateLength(Curve=flip_5.Curve, Length=Slider(0, range=0..10), Normalized=False)  # -> Point, Tangent, Parameter
pframe_11 = PerpFrame(Curve=reparameterize(flip_5.Curve), Parameter=Slider(0, range=0..1))
pframe_12 = PerpFrame(Curve=reparameterize(flip_5.Curve), Parameter=Slider(0.5, range=0..1))
vec2pt_6 = Vector2Pt(PointA=pframe_11, PointB=pframe_12, Unitize=False)  # -> Vector, Length
pl_7 = PlaneNormal(Origin=eval_11.Point, ZAxis=evalsrf.Normal)
align_9 = AlignPlane(Plane=pframe_10, Direction=evalsrf.Normal)  # -> Plane, Angle
align_10 = AlignPlane(Plane=pl_7, Direction=vec2pt_6.Vector)  # -> Plane, Angle
cir_6 = Circle(Plane=align_10.Plane, Radius=number_slider_17)
cir_7 = Circle(Plane=align_9.Plane, Radius=number_slider_17)
flip_6 = FlipCurve(Curve=cir_6)  # -> Curve, Flag
loft_7 = Loft(
    Curves=[cir_7, flip_6.Curve],
    Options={Adjust=False, Closed=False, LoftEnds=0, LoftSimp=0, LoftType=0, Rebuild=10, Refit=0.01})

pl_8 = PlaneNormal(Origin=eval.Point, ZAxis=dispatch.ListA)  # disabled
cir_8 = Circle(Plane=pl_8, Radius=number_slider_17)  # disabled
branch_14 = TreeBranch(Tree=cir_8, Path=number_slider_2, MaintainPaths=True)  # disabled
graft_12 = GraftTree(Tree=branch_14, IncludeEmptyLists=True, IncludeNullItems=True)  # disabled
series_4 = Series(Start=0, Step=Slider(0.1, range=0..0.1), Count=10)

# ---- group: Use This
# ANDREW :)
# 
# So I can't seem to make the circle that is suppose to rest on the plane of my individual panels align properly, I'm fairly sure it was to do with my data structure but I just can't seem to figure it out.
# 
# Also I can't seem to the the loft to work between the circles that make up the base of the arm and the surface on the middle plane of glass
vec = Vector(dispatch.ListA)
branch_15 = TreeBranch(Tree=vec, Path=number_slider_2, MaintainPaths=True)  # -> simplify(graft(Branch))

# ----
pframe_13 = PerpFrame(Curve=reparameterize(flip_4.Curve), Parameter=Slider(0, range=0..1))
pframe_14 = PerpFrame(Curve=reparameterize(flip_4.Curve), Parameter=Slider(0.5, range=0..1))
eval_12 = EvaluateLength(Curve=crv_6, Length=Slider(3, range=0..10), Normalized=False)  # -> Point, Tangent, Parameter
cull_i = CullIndex(List=series_4, Indices=0, Wrap=True)
rev_2 = ReverseList(List=cull_i)
vec2pt_7 = Vector2Pt(PointA=pframe_13, PointB=pframe_14, Unitize=False)  # -> Vector, Length
pl_9 = PlaneNormal(Origin=eval_12.Point, ZAxis=evalsrf.Normal)
cull_i_2 = CullIndex(List=rev_2, Indices=0, Wrap=True)
align_11 = AlignPlane(Plane=pl_9, Direction=vec2pt_7.Vector)  # -> Plane, Angle
eval_13 = EvaluateLength(Curve=reparameterize(flip_4.Curve), Length=cull_i_2, Normalized=True)  # -> Point, Tangent, Parameter
item_2 = ListItem(List=eval_13.Point, Index=0, Wrap=True)  # -> flatten(Item)

# ---- group: Circle Aligned to Middle Glass
cir_9 = Circle(Plane=align_11.Plane, Radius=number_slider_17)

# ----
pframe_15 = PerpFrame(Curve=reparameterize(flip_4.Curve), Parameter=eval_13.Parameter)
points_2 = PointList(Points=item_2)
flip_7 = FlipCurve(Curve=cir_9)  # -> simplify(Curve), Flag
align_12 = AlignPlane(Plane=pframe_15, Direction=evalsrf.Normal)  # -> Plane, Angle
cir_10 = Circle(Plane=align_12.Plane, Radius=number_slider_17)  # -> simplify(Circle)

# ---- group: Better off using this
vec_2 = Vector(dispatch.ListA)
eval_14 = EvaluateLength(Curve=crv_6, Length=Slider(3, range=0..10), Normalized=False)  # -> Point, Tangent, Parameter
eval_15 = EvaluateLength(Curve=flip_4.Curve, Length=Slider(0, range=0..10), Normalized=False)  # -> simplify(Point), Tangent, Parameter
pl_10 = PlaneNormal(Origin=eval_14.Point, ZAxis=evalsrf.Normal)
ext_2 = ExtendCurve(Curve=flip_4.Curve, Type=2, Start=10, End=10)
pipe_2 = Pipe(Curve=ext_2, Radius=number_slider_17, Caps=0)  # -> simplify(Pipe)
planesrf_2 = PlaneSurface(Plane=pl_10, XSize=Domain(-10, 10), YSize=Domain(-10, 10))  # -> simplify(Plane)
split_4 = SplitBrep(Brep=pipe_2, Cutter=planesrf_2)
item_3 = ListItem(List=split_4, Index=0, Wrap=True)

# ---- group: Need to sort
sort_3 = SortList(Keys=crv_cp.Parameter, ValuesA=vec_2)  # -> Keys, ValuesA

# ---- group: Better off using this (continued)
branch_16 = TreeBranch(Tree=sort_3.ValuesA, Path=number_slider_2, MaintainPaths=True)  # -> simplify(graft(Branch))
pl_11 = PlaneNormal(Origin=eval_15.Point, ZAxis=branch_16)
planesrf_3 = PlaneSurface(Plane=pl_11, XSize=Domain(-10, 10), YSize=Domain(-10, 10))  # -> simplify(Plane)
split_5 = SplitBrep(Brep=item_3, Cutter=planesrf_3)
item_4 = ListItem(List=reverse(split_5), Index=0, Wrap=True)
cap_2 = CapHoles(Brep=item_4)

# ---- group: Circle on the individual planes
eval_16 = EvaluateLength(Curve=flip_4.Curve, Length=Slider(0, range=0..10), Normalized=False)  # -> simplify(Point), Tangent, Parameter

# ---- group: Circle on the individual planes / What do Align this Too
pl_12 = PlaneNormal(Origin=eval_16.Point, ZAxis=branch_15)

# ---- group: Circle on the individual planes (continued)
align_13 = AlignPlane(Plane=pl_12, Direction=vec2pt_7.Vector)  # -> Plane, Angle
cir_11 = Circle(Plane=align_13.Plane, Radius=number_slider_17)
flip_8 = FlipCurve(Curve=cir_11)  # -> Curve, Flag

# ----
merge = Merge(Data1=flip_7.Curve, Data2=cir_10, Data3=flip_8.Curve)
loft_8 = Loft(Curves=merge, Options={Adjust=False, Closed=False, LoftEnds=0, LoftSimp=0, LoftType=0, Rebuild=10, Refit=0.01})
