# Grasshopper definition MT005 - AB Comments.gh (Grasshopper 0.9.76)

number_slider = Slider(150, range=0..200)
crv = Curve([<curve referenced from the Rhino model> x6])
loft = Loft(Curves=crv, Options={Adjust=False, Closed=False, LoftEnds=0, LoftSimp=0, LoftType=0, Rebuild=10, Refit=0.01})
srf = Surface(loft)
crv_2 = Curve(srf)
popgeo = PopulateGeometry(Geometry=crv_2, Count=Slider(24, range=0..100), Seed=1)
popgeo_2 = PopulateGeometry(Geometry=loft, Count=number_slider, Seed=1)
popgeo_3 = PopulateGeometry(Geometry=loft, Count=number_slider, Seed=1)
xz = XZPlane(Origin=Point(0, 0, 0))
# offset surface to define inside and outside
# create a line between the point on the mesh and the corresponding point on the offset surface. currently the line is connected mesh to offset surface (which may end up mattering)
offset = Offset(Surface=loft, Distance=Slider(150, range=0..500), Retrim=True)
del = DelaunayMesh(Points=[popgeo_2, popgeo], Plane=xz)
demesh = DeconstructMesh(Mesh=del)  # -> Vertices, Faces, Colours, Normals

# ---- group: Shows the points number on the mesh (currently very small
points = PointList(Points=demesh.Vertices, Size=Slider(67, range=0..100))

# ---- group: Find Vertex Point on Offset Surface
srf_cp = SurfaceClosestPoint(Point=demesh.Vertices, Surface=offset)  # -> Point, UVPoint, Distance

# ---- group: Line between surfaces
ln = Line(StartPoint=demesh.Vertices, EndPoint=srf_cp.Point)

# ---- group: Create Shape at end of line between surfaces
distance_from_panelled_srf = Slider(1, range=0..1)
pframe = PerpFrame(Curve=ln, Parameter=distance_from_panelled_srf)
polygon = Polygon(Plane=pframe, Radius=Slider(30, range=0..50), Segments=Slider(6, range=0..10), FilletRadius=0)  # -> Polygon, Length

# ----
# create a list with the vertex number in it. Test if this number corresponds to the corner of a face, if yes then assign a true value
# have a bunch of polygons that don't have a relationship to vertices, need to convert polygon list in to a format that relates to our vertex. deconstruct face, to give the three indexs, which can be tested against our vertexs
lng = ListLength(List=demesh.Vertices)
series = Series(Start=0, Step=1, Count=lng)
int = Integer(simplify(graft(series)))

# ----
# breaks down the edges of the polygon, (returns the index of the vertix it is connected too)
deface = DeconstructFace(Face=demesh.Faces)  # -> CornerA, CornerB, CornerC, CornerD

# ---- group: center of panel
facen = FaceNormals(Mesh=del)  # -> Centers, Normals

# ----
expression = Expression(x=int, y=deface.CornerA, Expression="x=y")
expression_2 = Expression(x=int, y=deface.CornerB, Expression="x=y")
# graft the interger list, so I have a branch for every vertices, we can then test each branch against every number in the already flat list of faces vertices
expression_3 = Expression(x=int, y=deface.CornerC, Expression="x=y")
or = GateOr(A=expression, B=expression_2, C=expression_3)

# ----
# Counts the number of panels each vertex is associated with
int_2 = Integer(or)
ma = MassAddition(Input=int_2)  # -> Result, PartialResults
panel = Panel(ma.Result)

# ---- group: Vertexs as Tree
pt = Point(demesh.Vertices)
graft = GraftTree(Tree=pt, IncludeEmptyLists=True, IncludeNullItems=True)  # -> simplify(Tree)

# ---- group: Points on Offset Srf
pt_2 = Point(srf_cp.Point)
graft_2 = GraftTree(Tree=pt_2, IncludeEmptyLists=True, IncludeNullItems=True)  # -> simplify(Tree)

# ---- group: Dispatch Normals of each panel
dispatch = Dispatch(List=facen.Normals, DispatchPattern=or)  # -> simplify(ListA), ListB

# ---- group: Dispatch center point of each panel
dispatch_2 = Dispatch(List=facen.Centers, DispatchPattern=or)  # -> simplify(ListA), ListB

# ---- group: Connect center and vertex
ln_2 = Line(StartPoint=dispatch_2.ListA, EndPoint=graft)

# ---- group: Distance from Panel Corner clamp attachs
eval = EvaluateLength(Curve=reparameterize(ln_2), Length=Slider(0.85, range=0..1), Normalized=True)  # -> Point, Tangent, Parameter

# ---- group: Lift Point off the panelled surface
amp = Amplitude(Vector=dispatch.ListA, Amplitude=Slider(3, range=0..5))
rev = Reverse(Vector=amp)
move = Move(Geometry=eval.Point, Motion=rev)  # -> Geometry, Transform

# ---- group: Main line of Clamp
ln_3 = Line(StartPoint=graft_2, EndPoint=eval.Point)

# ----
vec2pt = Vector2Pt(PointA=graft, PointB=graft_2, Unitize=False)  # -> Vector, Length
number_slider_2 = Slider(139, range=0..150)

# ---- group: Vector to offset surface and a plane at that point
vec2pt_2 = Vector2Pt(PointA=graft_2, PointB=graft, Unitize=False)  # -> Vector, Length
pl = PlaneNormal(Origin=graft_2, ZAxis=vec2pt_2.Vector)

# ---- group: Create a bounding box to trim geometry
number_slider_3 = Slider(220, range=0..408)
number_slider_4 = Slider(220, range=0..300)
dom = ConstructDomain(DomainStart=expr("-x/2", Slider(0, range=0..100)), DomainEnd=expr("x/2", Slider(500, range=0..500)))
dom_2 = ConstructDomain(DomainStart=expr("-x/2", number_slider_3), DomainEnd=expr("x/2", number_slider_3))
dom_3 = ConstructDomain(DomainStart=expr("-x/2", number_slider_4), DomainEnd=expr("x/2", number_slider_4))
box = DomainBox(Base=pl, X=dom_2, Y=dom_3, Z=dom)
branch = TreeBranch(Tree=box, Path=number_slider_2, MaintainPaths=True)

# ----
circle = CircleCNR(Center=eval.Point, Normal=dispatch.ListA, Radius=Slider(7.5, range=0..30))
circle_2 = CircleCNR(Center=move.Geometry, Normal=dispatch.ListA, Radius=Slider(7.5, range=0..30))
branch_2 = TreeBranch(Tree=circle_2, Path=number_slider_2, MaintainPaths=True)
branch_3 = TreeBranch(Tree=ln_3, Path=number_slider_2, MaintainPaths=True)
branch_4 = TreeBranch(Tree=circle, Path=number_slider_2, MaintainPaths=True)
graft_3 = GraftTree(Tree=branch_4, IncludeEmptyLists=True, IncludeNullItems=True)
graft_4 = GraftTree(Tree=branch_2, IncludeEmptyLists=True, IncludeNullItems=True)
graft_5 = GraftTree(Tree=branch_3, IncludeEmptyLists=True, IncludeNullItems=True)
pipe = Pipe(Curve=graft_5, Radius=Slider(6, range=0..10), Caps=0)
loft_2 = Loft(
    Curves=[graft_3, graft_4],
    Options={Adjust=False, Closed=False, LoftEnds=0, LoftSimp=0, LoftType=0, Rebuild=10, Refit=0.01})
cap = CapHoles(Brep=loft_2)
faceb = FaceBoundaries(Mesh=del)

# ---- group: Shape the Curves
number_slider_5 = Slider(0.331, range=0..1)
number_slider_6 = Slider(1, range=0..1)
number_slider_7 = Slider(0.131, range=0..1)
number_slider_8 = Slider(0, range=0..1)
number_slider_9 = Slider(0.725, range=0..1)
number_slider_10 = Slider(1, range=0..1)
number_slider_11 = Slider(0.304, range=0..1)
number_slider_12 = Slider(0, range=0..1)

# ----
pln = Plane(simplify(graft(pframe)))
crv_3 = Curve(ln_3)
# dispatch the faces associated with the branch number
dispatch_3 = Dispatch(List=faceb, DispatchPattern=or)  # -> simplify(ListA), ListB
lng_2 = ListLength(List=crv_3)
branch_5 = TreeBranch(Tree=dispatch_3.ListA, Path=number_slider_2, MaintainPaths=True)
eval_2 = EvaluateCurve(Curve=reparameterize(graft(crv_3)), Parameter=[number_slider_8, number_slider_7, number_slider_5, number_slider_6])  # -> simplify(Point), Tangent, Angle
eval_3 = EvaluateCurve(Curve=reparameterize(graft(crv_3)), Parameter=[number_slider_12, number_slider_11, number_slider_9, number_slider_10])  # -> simplify(Point), Tangent, Angle
repeat = RepeatData(Data=pln, Length=lng_2)  # -> simplify(Data)
cir = Circle(Plane=pln, Radius=10)
project = Project(Geometry=crv_3, Plane=pln)  # -> Geometry, Transform
planar = Planar(Curve=branch_5)  # -> Planar, Plane, Deviation
graft_6 = GraftTree(Tree=repeat, IncludeEmptyLists=True, IncludeNullItems=True)
ccx = CurveCurve(CurveA=project.Geometry, CurveB=cir)  # -> Points, ParamsA, ParamsB
pl_origin = PlaneOrigin(Base=graft_6, Origin=eval_2.Point)
trim = TrimTree(Tree=ccx.ParamsB, Depth=1)
project_2 = Project(Geometry=eval_3.Point, Plane=pl_origin)  # -> Geometry, Transform
# offset the panels at this step before boundary surface if the panels are going to overlap (convex joint)
offset_2 = Offset(Curve=branch_5, Distance=expr("-x", Slider(5, range=0..10)), Plane=planar.Plane, Corners=1)

# ---- group: How do I get rid of this
eval_4 = EvaluateLength(Curve=reparameterize(ln_3), Length=Slider(0.5, range=0..1), Normalized=True)  # -> Point, Tangent, Parameter
pt_3 = Point(eval_4.Point)
fcircle = CircleFit(Points=eval_4.Point)  # -> Circle, Radius, Deviation
crv_cp = CurveClosestPoint(Point=pt_3, Curve=reparameterize(fcircle.Circle))  # -> Point, Parameter, Distance

# ----
shatter = Shatter(Curve=cir, Parameters=trim)
intcrv = Interpolate(Vertices=project_2.Geometry, Degree=3, Periodic=False, KnotStyle=1)  # -> Curve, Length, Domain
eval_5 = EvaluateCurve(Curve=reparameterize(shatter), Parameter=0.5)  # -> Point, Tangent, Angle
deplane = DeconstructPlane(Plane=pln)  # -> Origin, XAxis, YAxis, ZAxis
trim_2 = TrimTree(Tree=intcrv.Curve, Depth=1)
sort = SortList(Keys=crv_cp.Parameter, ValuesA=trim_2)  # -> Keys, ValuesA
vec2pt_3 = Vector2Pt(PointA=deplane.Origin, PointB=eval_5.Point, Unitize=False)  # -> Vector, Length
pl_2 = ConstructPlane(Origin=deplane.Origin, XAxis=vec2pt_3.Vector, YAxis=deplane.ZAxis)  # -> simplify(Plane)

# ---- group: Curve to Trim at Panel
branch_6 = TreeBranch(Tree=sort.ValuesA, Path=number_slider_2, MaintainPaths=True)

# ----
fillet = Fillet(Curve=offset_2, Radius=Slider(28, range=0..30))

# ---- group: make panels into surface
boundary = BoundarySurfaces(Edges=fillet)

# ----
branch_7 = TreeBranch(Tree=pl_2, Path=number_slider_2, MaintainPaths=True)

# ---- group: Extend Curve Past Glass
l0 = Start(100)
ext = ExtendCurve(Curve=branch_6, Type=2, Start=0, End=l0)

# ----
planesrf = PlaneSurface(Plane=branch_7, XSize=Domain(0, 1000), YSize=Domain(-1000, 1000))
loft_3 = Loft(Curves=branch_6, Options={Adjust=False, Closed=True, LoftEnds=0, LoftSimp=0, LoftType=0, Rebuild=10, Refit=0.01})

# ---- group: Cut the panes so they fit in the box
split = SplitBrep(Brep=boundary, Cutter=branch)
mesh = MeshBrep(
    Brep=split,
    Settings={GridMaxCount=0, GridMinCount=16, JaggedSeams=False, MaxEdgeLength=0, MinEdgeLength=0.0001, MinTolerance=0, Refine=True, RefineAngle=0, RelativeTolerance=0.65, SimplePlanes=True, Tolerance=0})
facen_2 = FaceNormals(Mesh=mesh)  # -> Centers, Normals
item = ListItem(List=facen_2.Centers, Index=0, Wrap=True)
brepinc = PointInBrep(Brep=branch, Point=item, Strict=False)  # -> simplify(Inside)
trim_3 = TrimTree(Tree=brepinc, Depth=1)
dispatch_4 = Dispatch(List=split, DispatchPattern=trim_3)  # -> ListA, ListB
geo = Geometry(dispatch_4.ListA)
crv_4 = Curve(flatten(geo))

# ---- group: Curve to Trim on top half
bbx = BrepBrep(BrepA=loft_3, BrepB=planesrf)  # -> Curves, Points

# ----
eval_6 = EvaluateLength(Curve=reparameterize(branch_6), Length=Slider(0.7, range=0..1), Normalized=True)  # -> Point, Tangent, Parameter
lng_3 = ListLength(List=branch_5)
pt_4 = Point(eval_6.Point)
series_2 = Series(Start=0, Step=Slider(300, range=0..300), Count=lng_3)
fcircle_2 = CircleFit(Points=pt_4)  # -> Circle, Radius, Deviation
pt_5 = ConstructPoint(XCoordinate=series_2, YCoordinate=0, ZCoordinate=0)
crv_cp_2 = CurveClosestPoint(Point=pt_4, Curve=reparameterize(fcircle_2.Circle))  # -> Point, Parameter, Distance
xy = XYPlane(Origin=pt_5)

# ---- group: Polyline based on the top hinges
pline = PolyLine(Vertices=crv_cp_2.Point, Closed=True)

# ----
offset_3 = Offset(Curve=pline, Distance=expr("-x", Slider(20, range=0..100)), Plane=PlaneXY(0, 0, 0), Corners=3)
faceb_2 = FaceBoundaries(Mesh=crv_4)
srf_2 = Surface(offset_3)
area = Area(Geometry=geo)  # -> Area, Centroid
scx = SurfaceCurve(Surface=srf_2, Curve=[bbx.Curves, branch_6])  # -> Curves, Points, UVPoints, Normals, Parameters, Tangents
evalsrf = EvaluateSurface(Surface=geo, Point=area.Centroid)  # -> Point, Normal, Frame
pt_6 = Point(flatten(scx.Points))
amp_2 = Amplitude(Vector=evalsrf.Normal, Amplitude=Slider(3, range=0..10))
planar_2 = Planar(Curve=crv_4)  # -> Planar, Plane, Deviation

# ---- group: Orient pad on surface
branch_8 = TreeBranch(Tree=circle, Path=number_slider_2, MaintainPaths=True)
orient = Orient(Geometry=branch_8, Source=planar_2.Plane, Target=xy)  # -> Geometry, Transform

# ----
fcircle_3 = CircleFit(Points=pt_6)  # -> Circle, Radius, Deviation
move_2 = Move(Geometry=geo, Motion=amp_2)  # -> Geometry, Transform
crv_cp_3 = CurveClosestPoint(Point=pt_6, Curve=reparameterize(fcircle_3.Circle))  # -> Point, Parameter, Distance
loft_4 = Loft(
    Curves=[move_2.Geometry, geo],
    Options={Adjust=False, Closed=False, LoftEnds=0, LoftSimp=0, LoftType=0, Rebuild=10, Refit=0.01})
orient_2 = Orient(Geometry=crv_4, Source=planar_2.Plane, Target=xy)  # -> Geometry, Transform
sort_2 = SortList(Keys=crv_cp_3.Parameter, ValuesA=crv_cp_3.Point)  # -> Keys, ValuesA
cap_2 = CapHoles(Brep=loft_4)

# ---- group: Polyline based on all the lines intersections
pline_2 = PolyLine(Vertices=sort_2.ValuesA, Closed=True)

# ----
offset_4 = Offset(Curve=pline_2, Distance=expr("-x", Slider(25, range=0..100)), Plane=PlaneXY(0, 0, 0), Corners=3)
srf_3 = Surface(offset_4)
area_2 = Area(Geometry=srf_3)  # -> Area, Centroid
evalsrf_2 = EvaluateSurface(Surface=srf_3, Point=area_2.Centroid)  # -> Point, Normal, Frame
circle_3 = CircleCNR(Center=pt_6, Normal=evalsrf_2.Normal, Radius=Slider(4, range=0..10))
rdiff = RegionDifference(CurvesA=srf_3, CurvesB=circle_3)
crv_5 = Curve([circle_3, rdiff])
item_2 = ListItem(List=rdiff, Index=0, Wrap=True)
srf_4 = Surface(rdiff)
area_3 = Area(Geometry=srf_3)  # -> Area, Centroid
evalsrf_3 = EvaluateSurface(Surface=srf_3, Point=area_3.Centroid)  # -> Point, Normal, Frame
amp_3 = Amplitude(Vector=evalsrf_3.Normal, Amplitude=Slider(3, range=0..10))
brep = Brep(srf_3)
area_4 = Area(Geometry=srf_3)  # -> Area, Centroid
split_2 = SplitWithBrep(Curve=bbx.Curves, Brep=brep)  # -> Curve, Points
move_3 = Move(Geometry=srf_3, Motion=amp_3)  # -> Geometry, Transform
split_3 = SplitWithBrep(Curve=branch_6, Brep=brep)  # -> Curve, Points
simplify = SimplifyTree(Tree=split_2.Curve, Front=False)
evalsrf_4 = EvaluateSurface(Surface=srf_3, Point=area_4.Centroid)  # -> Point, Normal, Frame
loft_5 = Loft(
    Curves=[move_3.Geometry, srf_3],
    Options={Adjust=False, Closed=False, LoftEnds=0, LoftSimp=0, LoftType=0, Rebuild=10, Refit=0.01})
dispatch_5 = Dispatch(List=simplify, DispatchPattern=[True, False])  # -> ListA, ListB
simplify_2 = SimplifyTree(Tree=split_3.Curve, Front=False)
dispatch_6 = Dispatch(List=simplify_2, DispatchPattern=[True, False])  # -> ListA, ListB
cap_3 = CapHoles(Brep=loft_5)
branch_9 = TreeBranch(Tree=dispatch.ListA, Path=number_slider_2, MaintainPaths=True)
crv_6 = Curve(dispatch_6.ListB)
crv_7 = Curve(dispatch_6.ListA)

# ---- group: Distance Along Line
number_slider_13 = Slider(0.22, range=0..1)

# ----
graft_7 = GraftTree(Tree=branch_9, IncludeEmptyLists=True, IncludeNullItems=True)

# ---- group: Glass Thickness
number_slider_14 = Slider(3, range=0..10)

# ----
number_slider_15 = Slider(7.5, range=0..10)

flip = FlipCurve(Curve=dispatch_5.ListA)  # -> Curve, Flag
pframe_2 = PerpFrame(Curve=reparameterize(flip.Curve), Parameter=number_slider_13)
eval_7 = EvaluateLength(Curve=flip.Curve, Length=number_slider_14, Normalized=False)  # -> Point, Tangent, Parameter
pframe_3 = PerpFrame(Curve=reparameterize(flip.Curve), Parameter=Slider(0, range=0..1))
pframe_4 = PerpFrame(Curve=reparameterize(flip.Curve), Parameter=Slider(0.5, range=0..1))
vec2pt_4 = Vector2Pt(PointA=pframe_3, PointB=pframe_4, Unitize=False)  # -> Vector, Length
pl_3 = PlaneNormal(Origin=eval_7.Point, ZAxis=evalsrf_4.Normal)
align = AlignPlane(Plane=pframe_2, Direction=evalsrf_4.Normal)  # -> Plane, Angle
align_2 = AlignPlane(Plane=pl_3, Direction=vec2pt_4.Vector)  # -> Plane, Angle
cir_2 = Circle(Plane=align_2.Plane, Radius=number_slider_15)
cir_3 = Circle(Plane=align.Plane, Radius=number_slider_15)
rotate = Rotate(Geometry=cir_2, Angle=degrees(Slider(180, range=0..180)), Plane=align_2.Plane)  # -> Geometry, Transform
loft_6 = Loft(
    Curves=[cir_3, rotate.Geometry],
    Options={Adjust=False, Closed=False, LoftEnds=0, LoftSimp=0, LoftType=0, Rebuild=10, Refit=0.01})

# ---- group: Main Body
flip_2 = FlipCurve(Curve=dispatch_5.ListB)  # -> Curve, Flag
series_3 = Series(Start=0, Step=Slider(0.1, range=0..0.1), Count=10)
eval_8 = EvaluateLength(Curve=reparameterize(flip_2.Curve), Length=Slider(1, range=0..1), Normalized=True)  # -> Point, Tangent, Parameter
eval_9 = EvaluateLength(Curve=reparameterize(flip_2.Curve), Length=series_3, Normalized=True)  # -> Point, Tangent, Parameter
pframe_5 = PerpFrame(Curve=reparameterize(flip_2.Curve), Parameter=Slider(0, range=0..1))
pframe_6 = PerpFrame(Curve=reparameterize(flip_2.Curve), Parameter=Slider(0.5, range=0..1))
pframe_7 = PerpFrame(Curve=reparameterize(flip_2.Curve), Parameter=eval_9.Parameter)
vec2pt_5 = Vector2Pt(PointA=pframe_5, PointB=pframe_6, Unitize=False)  # -> Vector, Length
pl_4 = PlaneNormal(Origin=eval_8.Point, ZAxis=evalsrf_4.Normal)
align_3 = AlignPlane(Plane=pframe_7, Direction=evalsrf_4.Normal)  # -> Plane, Angle
align_4 = AlignPlane(Plane=pl_4, Direction=vec2pt_5.Vector)  # -> Plane, Angle
cir_4 = Circle(Plane=align_3.Plane, Radius=number_slider_15)
cir_5 = Circle(Plane=align_4.Plane, Radius=number_slider_15)
flip_3 = FlipCurve(Curve=cir_5)  # -> Curve, Flag
rotate_2 = Rotate(Geometry=cir_5, Angle=degrees(Slider(180, range=0..180)), Plane=align_4.Plane)  # -> Geometry, Transform
loft_7 = Loft(
    Curves=[cir_4, rotate_2.Geometry],
    Options={Adjust=False, Closed=False, LoftEnds=0, LoftSimp=0, LoftType=0, Rebuild=10, Refit=0.01})

# ----
flip_4 = FlipCurve(Curve=crv_6)  # -> Curve, Flag
pl_5 = PlaneNormal(Origin=eval.Point, ZAxis=dispatch.ListA)  # disabled
cir_6 = Circle(Plane=pl_5, Radius=number_slider_15)  # disabled
branch_10 = TreeBranch(Tree=cir_6, Path=number_slider_2, MaintainPaths=True)  # disabled
graft_8 = GraftTree(Tree=branch_10, IncludeEmptyLists=True, IncludeNullItems=True)  # disabled
cap_4 = CapHoles(Brep=loft_6)
cap_5 = CapHoles(Brep=loft_7)
area_5 = Area(Geometry=cir_5)  # -> Area, Centroid
area_6 = Area(Geometry=cir_5)  # -> Area, Centroid
pframe_8 = PerpFrame(Curve=reparameterize(flip.Curve), Parameter=Slider(0.14, range=0..1))
number_slider_16 = Slider(3, range=0..10)
pframe_9 = PerpFrame(Curve=reparameterize(flip.Curve), Parameter=Slider(0.19, range=0..1))
pl_6 = PlaneNormal(Origin=area_5.Centroid, ZAxis=evalsrf_4.Normal)
pl_7 = PlaneNormal(Origin=area_6.Centroid, ZAxis=evalsrf_4.Normal)
number_slider_17 = Slider(3.61, range=0..10)
align_5 = AlignPlane(Plane=pframe_8, Direction=evalsrf_4.Normal)  # -> Plane, Angle
align_6 = AlignPlane(Plane=pframe_9, Direction=evalsrf_4.Normal)  # -> Plane, Angle
align_7 = AlignPlane(Plane=pl_6, Direction=vec2pt_5.Vector)  # -> Plane, Angle
align_8 = AlignPlane(Plane=pl_7, Direction=vec2pt_5.Vector)  # -> Plane, Angle
cir_7 = Circle(Plane=align_7.Plane, Radius=number_slider_16)
cir_8 = Circle(Plane=align_5.Plane, Radius=number_slider_16)
cir_9 = Circle(Plane=align_8.Plane, Radius=number_slider_17)
cir_10 = Circle(Plane=align_6.Plane, Radius=number_slider_17)
rotate_3 = Rotate(Geometry=cir_7, Angle=degrees(Slider(180, range=0..180)), Plane=pl_6)  # -> Geometry, Transform
rotate_4 = Rotate(Geometry=cir_9, Angle=degrees(Slider(180, range=0..180)), Plane=pl_7)  # -> Geometry, Transform
loft_8 = Loft(
    Curves=[rotate_3.Geometry, cir_8],
    Options={Adjust=False, Closed=False, LoftEnds=0, LoftSimp=0, LoftType=0, Rebuild=10, Refit=0.01})
loft_9 = Loft(
    Curves=[rotate_4.Geometry, cir_10],
    Options={Adjust=False, Closed=False, LoftEnds=0, LoftSimp=0, LoftType=0, Rebuild=10, Refit=0.01})
cap_6 = CapHoles(Brep=loft_8)
cap_7 = CapHoles(Brep=loft_9)

flip_5 = FlipCurve(Curve=crv_7)  # -> Curve, Flag
pframe_10 = PerpFrame(Curve=reparameterize(flip_5.Curve), Parameter=Slider(0.06, range=0..1))
eval_10 = EvaluateLength(Curve=flip_5.Curve, Length=Slider(0, range=0..10), Normalized=False)  # -> Point, Tangent, Parameter
pframe_11 = PerpFrame(Curve=reparameterize(flip_5.Curve), Parameter=Slider(0, range=0..1))
pframe_12 = PerpFrame(Curve=reparameterize(flip_5.Curve), Parameter=Slider(0.5, range=0..1))
vec2pt_6 = Vector2Pt(PointA=pframe_11, PointB=pframe_12, Unitize=False)  # -> Vector, Length
pl_8 = PlaneNormal(Origin=eval_10.Point, ZAxis=evalsrf_4.Normal)
align_9 = AlignPlane(Plane=pframe_10, Direction=evalsrf_4.Normal)  # -> Plane, Angle
align_10 = AlignPlane(Plane=pl_8, Direction=vec2pt_6.Vector)  # -> Plane, Angle
cir_11 = Circle(Plane=align_10.Plane, Radius=number_slider_15)
cir_12 = Circle(Plane=align_9.Plane, Radius=number_slider_15)
flip_6 = FlipCurve(Curve=cir_11)  # -> Curve, Flag
loft_10 = Loft(
    Curves=[cir_12, flip_6.Curve],
    Options={Adjust=False, Closed=False, LoftEnds=0, LoftSimp=0, LoftType=0, Rebuild=10, Refit=0.01})

branch_11 = TreeBranch(Tree=graft_2, Path=number_slider_2, MaintainPaths=True)
branch_12 = TreeBranch(Tree=vec2pt.Vector, Path=number_slider_2, MaintainPaths=True)
graft_9 = GraftTree(Tree=branch_12, IncludeEmptyLists=True, IncludeNullItems=True)
graft_10 = GraftTree(Tree=branch_11, IncludeEmptyLists=True, IncludeNullItems=True)

pt_7 = Point(graft_10)
pl_9 = PlaneNormal(Origin=pt_7, ZAxis=graft_9)
cir_13 = Circle(Plane=pl_9, Radius=Slider(8.5, range=0..10))
amp_4 = Amplitude(Vector=graft_9, Amplitude=expr("-x", Slider(24, range=0..30)))
amp_5 = Amplitude(Vector=graft_9, Amplitude=Slider(38, range=0..40))
move_4 = Move(Geometry=cir_13, Motion=amp_5)  # -> Geometry, Transform
move_5 = Move(Geometry=cir_13, Motion=amp_4)  # -> Geometry, Transform
loft_11 = Loft(
    Curves=[move_4.Geometry, move_5.Geometry],
    Options={Adjust=False, Closed=False, LoftEnds=0, LoftSimp=0, LoftType=0, Rebuild=10, Refit=0.01})
cap_8 = CapHoles(Brep=loft_11)

pt_8 = Point(graft_10)
pl_10 = PlaneNormal(Origin=pt_8, ZAxis=graft_9)
amp_6 = Amplitude(Vector=graft_9, Amplitude=expr("-x", Slider(18, range=0..30)))
cir_14 = Circle(Plane=pl_10, Radius=Slider(12, range=0..15))
amp_7 = Amplitude(Vector=graft_9, Amplitude=Slider(8, range=0..10))
move_6 = Move(Geometry=cir_14, Motion=amp_7)  # -> Geometry, Transform
move_7 = Move(Geometry=cir_14, Motion=amp_6)  # -> Geometry, Transform
loft_12 = Loft(
    Curves=[move_6.Geometry, move_7.Geometry],
    Options={Adjust=False, Closed=False, LoftEnds=0, LoftSimp=0, LoftType=0, Rebuild=10, Refit=0.01})
cap_9 = CapHoles(Brep=loft_12)

pt_9 = Point(graft_10)
pl_11 = PlaneNormal(Origin=pt_9, ZAxis=graft_9)

# ---- group: Hole
vec = Vector(dispatch.ListA)
sort_3 = SortList(Keys=crv_cp.Parameter, ValuesA=vec)  # -> Keys, ValuesA
branch_13 = TreeBranch(Tree=sort_3.ValuesA, Path=number_slider_2, MaintainPaths=True)  # -> simplify(graft(Branch))
ext_2 = ExtendCurve(Curve=flip_4.Curve, Type=0, Start=Slider(10, range=0..20), End=0)
eval_11 = EvaluateLength(Curve=crv_6, Length=Slider(3, range=0..10), Normalized=False)  # -> Point, Tangent, Parameter
eval_12 = EvaluateLength(Curve=flip_4.Curve, Length=Slider(35, range=0..50), Normalized=False)  # -> simplify(Point), Tangent, Parameter
pl_12 = PlaneNormal(Origin=eval_11.Point, ZAxis=evalsrf_4.Normal)
pl_13 = PlaneNormal(Origin=eval_12.Point, ZAxis=branch_13)
planesrf_2 = PlaneSurface(Plane=pl_12, XSize=Domain(-10, 10), YSize=Domain(-10, 10))  # -> simplify(Plane)
pipe_2 = Pipe(Curve=ext_2, Radius=Slider(3.5, range=0..10), Caps=0)  # -> simplify(Pipe)
pane = PlaneSurface(Plane=pl_13, XSize=Domain(-10, 10), YSize=Domain(-10, 10))  # -> simplify(Plane)
split_4 = SplitBrep(Brep=pipe_2, Cutter=planesrf_2)
item_3 = ListItem(List=split_4, Index=0, Wrap=True)
split_5 = SplitBrep(Brep=item_3, Cutter=pane)
item_4 = ListItem(List=reverse(split_5), Index=0, Wrap=True)
cap_10 = CapHoles(Brep=item_4)

# ---- group: Inner Piece
vec_2 = Vector(dispatch.ListA)
sort_4 = SortList(Keys=crv_cp.Parameter, ValuesA=vec_2)  # -> Keys, ValuesA
branch_14 = TreeBranch(Tree=sort_4.ValuesA, Path=number_slider_2, MaintainPaths=True)  # -> simplify(graft(Branch))
ext_3 = ExtendCurve(Curve=flip_4.Curve, Type=0, Start=Slider(10, range=0..20), End=0)
eval_13 = EvaluateLength(Curve=crv_6, Length=Slider(0, range=0..10), Normalized=False)  # -> Point, Tangent, Parameter
eval_14 = EvaluateLength(Curve=flip_4.Curve, Length=Slider(39, range=0..50), Normalized=False)  # -> simplify(Point), Tangent, Parameter
pl_14 = PlaneNormal(Origin=eval_13.Point, ZAxis=evalsrf_4.Normal)
pl_15 = PlaneNormal(Origin=eval_14.Point, ZAxis=branch_14)
planesrf_3 = PlaneSurface(Plane=pl_14, XSize=Domain(-10, 10), YSize=Domain(-10, 10))  # -> simplify(Plane)
pipe_3 = Pipe(Curve=ext_3, Radius=Slider(3, range=0..10), Caps=0)  # -> simplify(Pipe)
pane_2 = PlaneSurface(Plane=pl_15, XSize=Domain(-10, 10), YSize=Domain(-10, 10))  # -> simplify(Plane)
split_6 = SplitBrep(Brep=pipe_3, Cutter=planesrf_3)
item_5 = ListItem(List=split_6, Index=0, Wrap=True)
split_7 = SplitBrep(Brep=item_5, Cutter=pane_2)
item_6 = ListItem(List=reverse(split_7), Index=0, Wrap=True)
cap_11 = CapHoles(Brep=item_6)

# ----
cir_15 = Circle(Plane=pl_11, Radius=Slider(8, range=0..10))
amp_8 = Amplitude(Vector=graft_9, Amplitude=expr("-x", Slider(24, range=0..30)))
amp_9 = Amplitude(Vector=graft_9, Amplitude=Slider(38, range=0..40))
move_8 = Move(Geometry=cir_15, Motion=amp_9)  # -> Geometry, Transform
move_9 = Move(Geometry=cir_15, Motion=amp_8)  # -> Geometry, Transform
number_slider_18 = Slider(150, range=0..408)
loft_13 = Loft(
    Curves=[move_8.Geometry, move_9.Geometry],
    Options={Adjust=False, Closed=False, LoftEnds=0, LoftSimp=0, LoftType=0, Rebuild=10, Refit=0.01})
cap_12 = CapHoles(Brep=loft_13)
dom_4 = ConstructDomain(DomainStart=expr("-x/2", Slider(0, range=0..100)), DomainEnd=expr("x/2", Slider(15, range=0..500)))
dom_5 = ConstructDomain(DomainStart=expr("-x/2", number_slider_18), DomainEnd=expr("x/2", number_slider_18))
dom_6 = ConstructDomain(DomainStart=expr("-x/2", number_slider_18), DomainEnd=expr("x/2", number_slider_18))
box_2 = DomainBox(Base=pl_11, X=dom_5, Y=dom_6, Z=dom_4)
move_10 = Move(Geometry=box_2, Motion=amp_9)  # -> Geometry, Transform
join = BrepJoin(Breps=[cap_12, move_10.Geometry])  # -> Breps, Closed
join_2 = BrepJoin(Breps=[cap_5, cap_6])  # -> Breps, Closed

# ---- group: Not joining as there is nothing touching. Try cap then boolean
merge = Merge(Data1=simplify(loft_10), Data2=simplify(cap_11))

# ----
join_3 = BrepJoin(Breps=[join_2.Breps, cap_9])  # -> Breps, Closed
sdiff = SolidDifference(BrepsA=cap_4, BrepsB=cap_7)

debrep = DeconstructBrep(Brep=sdiff)  # -> Faces, Edges, Vertices
item_7 = ListItem(List=debrep.Faces, Index=1, Wrap=True)
planar_3 = IsPlanar(Surface=item_7, Interior=True)  # -> Planar, flatten(Plane)
lng_4 = ListLength(List=planar_3.Plane)
series_4 = Series(Start=Slider(27.084, range=0..50), Step=Slider(19.147, range=0..50), Count=lng_4)
pt_10 = ConstructPoint(XCoordinate=series_4, YCoordinate=0, ZCoordinate=0)
Z = UnitZ(Factor=-1)
pl_16 = PlaneNormal(Origin=pt_10, ZAxis=Z)

join_4 = BrepJoin(Breps=merge)  # -> Breps, Closed
debrep_2 = DeconstructBrep(Brep=join_4.Breps)  # -> Faces, Edges, Vertices
item_8 = ListItem(List=debrep_2.Faces, Index=0, Wrap=True)
pt_11 = ConstructPoint(XCoordinate=0, YCoordinate=0, ZCoordinate=0)
sdiff_2 = SolidDifference(BrepsA=join_3.Breps, BrepsB=cap_8)
xy_2 = XYPlane(Origin=pt_11)
planar_4 = IsPlanar(Surface=srf_3, Interior=True)  # -> Planar, Plane
pln_2 = Plane(planar_4.Plane)
# ideally these would be oriented with the hole facing up to prevent supports being needed in the printing
orient_3 = Orient(Geometry=flatten(sdiff), Source=planar_3.Plane, Target=pl_16)  # -> Geometry, Transform
orient_4 = Orient(Geometry=crv_5, Source=pln_2, Target=xy_2)  # -> Geometry, Transform
orient_5 = Orient(Geometry=sdiff_2, Source=pl_10, Target=xy_2)  # -> Geometry, Transform
# Trying to orient the flat faces to the xy, every time i try and find a plane they explode apart, I'm not sure if its a graft/tree problem
orient_6 = Orient(Geometry=join_4.Breps, Source=pl_15, Target=xy_2)  # -> Geometry, Transform
panel_2 = Panel("working")

# ---- group: Outer Most Cap
number_slider_19 = Slider(10, range=0..10)
vec_3 = Vector(dispatch.ListA)
sort_5 = SortList(Keys=crv_cp.Parameter, ValuesA=vec_3)  # -> Keys, ValuesA
branch_15 = TreeBranch(Tree=sort_5.ValuesA, Path=number_slider_2, MaintainPaths=True)  # -> simplify(graft(Branch))

# ----
number_slider_20 = Slider(10, range=0..10)
vec_4 = Vector(dispatch.ListA)
sort_6 = SortList(Keys=crv_cp.Parameter, ValuesA=vec_4)  # -> Keys, ValuesA
branch_16 = TreeBranch(Tree=sort_6.ValuesA, Path=number_slider_2, MaintainPaths=True)  # -> simplify(graft(Branch))

number_slider_21 = Slider(10, range=0..10)
vec_5 = Vector(dispatch.ListA)
sort_7 = SortList(Keys=crv_cp.Parameter, ValuesA=vec_5)  # -> Keys, ValuesA
branch_17 = TreeBranch(Tree=sort_7.ValuesA, Path=number_slider_2, MaintainPaths=True)  # -> simplify(graft(Branch))

vec_6 = Vector(dispatch.ListA)
sort_8 = SortList(Keys=crv_cp.Parameter, ValuesA=vec_6)  # -> Keys, ValuesA
branch_18 = TreeBranch(Tree=sort_8.ValuesA, Path=number_slider_2, MaintainPaths=True)  # -> simplify(graft(Branch))
ext_4 = ExtendCurve(Curve=flip_4.Curve, Type=0, Start=Slider(10, range=0..20), End=0)
eval_15 = EvaluateLength(Curve=crv_6, Length=Slider(3, range=0..10), Normalized=False)  # -> Point, Tangent, Parameter
eval_16 = EvaluateLength(Curve=flip_4.Curve, Length=Slider(0, range=0..10), Normalized=False)  # -> simplify(Point), Tangent, Parameter
pl_17 = PlaneNormal(Origin=eval_15.Point, ZAxis=evalsrf_4.Normal)
pl_18 = PlaneNormal(Origin=eval_16.Point, ZAxis=branch_18)
pipe_4 = Pipe(Curve=ext_4, Radius=number_slider_15, Caps=0)  # -> simplify(Pipe)

# ---- group: on Middle Surface
planesrf_4 = PlaneSurface(Plane=pl_17, XSize=Domain(-10, 10), YSize=Domain(-10, 10))  # -> simplify(Plane)

# ---- group: on Panel
pane_3 = PlaneSurface(Plane=pl_18, XSize=Domain(-10, 10), YSize=Domain(-10, 10))  # -> simplify(Plane)

# ----
brep_2 = Brep(pane_3)
split_8 = SplitWithBrep(Curve=ext_4, Brep=brep_2)  # -> Curve, Points
simplify_3 = SimplifyTree(Tree=split_8.Curve, Front=False)
dispatch_7 = Dispatch(List=simplify_3, DispatchPattern=[True, False])  # -> ListA, ListB
crv_8 = Curve(dispatch_7.ListA)

# ---- group: Outer Most Cap (continued)
ext_5 = ExtendCurve(Curve=crv_8, Type=0, Start=number_slider_19, End=number_slider_19)
eval_17 = EvaluateLength(Curve=crv_8, Length=Slider(7, range=0..10), Normalized=False)  # -> Point, Tangent, Parameter
eval_18 = EvaluateLength(Curve=ext_5, Length=Slider(7.3, range=0..10), Normalized=False)  # -> simplify(Point), Tangent, Parameter
pl_19 = PlaneNormal(Origin=eval_18.Point, ZAxis=branch_15)
pl_20 = PlaneNormal(Origin=eval_17.Point, ZAxis=branch_15)
pane_4 = PlaneSurface(Plane=pl_19, XSize=Domain(-10, 10), YSize=Domain(-10, 10))  # -> simplify(Plane)
pipe_5 = Pipe(Curve=ext_5, Radius=number_slider_15, Caps=0)  # -> simplify(Pipe)
planesrf_5 = PlaneSurface(Plane=pl_20, XSize=Domain(-10, 10), YSize=Domain(-10, 10))  # -> simplify(Plane)
split_9 = SplitBrep(Brep=pipe_5, Cutter=planesrf_5)
item_9 = ListItem(List=split_9, Index=0, Wrap=True)
split_10 = SplitBrep(Brep=item_9, Cutter=pane_4)
item_10 = ListItem(List=reverse(split_10), Index=0, Wrap=True)
cap_13 = CapHoles(Brep=item_10)

# ----
crv_9 = Curve(dispatch_7.ListB)

ext_6 = ExtendCurve(Curve=crv_8, Type=0, Start=number_slider_20, End=number_slider_20)
eval_19 = EvaluateLength(Curve=ext_6, Length=Slider(9.1, range=0..10), Normalized=False)  # -> simplify(Point), Tangent, Parameter
eval_20 = EvaluateLength(Curve=crv_8, Length=Slider(10, range=0..10), Normalized=False)  # -> Point, Tangent, Parameter
pl_21 = PlaneNormal(Origin=eval_19.Point, ZAxis=branch_16)
pl_22 = PlaneNormal(Origin=eval_20.Point, ZAxis=branch_16)
pipe_6 = Pipe(Curve=ext_6, Radius=Slider(3, range=0..10), Caps=0)  # -> simplify(Pipe)
pane_5 = PlaneSurface(Plane=pl_21, XSize=Domain(-10, 10), YSize=Domain(-10, 10))  # -> simplify(Plane)
planesrf_6 = PlaneSurface(Plane=pl_22, XSize=Domain(-10, 10), YSize=Domain(-10, 10))  # -> simplify(Plane)
split_11 = SplitBrep(Brep=pipe_6, Cutter=planesrf_6)
item_11 = ListItem(List=split_11, Index=0, Wrap=True)
split_12 = SplitBrep(Brep=item_11, Cutter=pane_5)
item_12 = ListItem(List=reverse(split_12), Index=0, Wrap=True)
cap_14 = CapHoles(Brep=item_12)

ext_7 = ExtendCurve(Curve=crv_8, Type=0, Start=number_slider_21, End=number_slider_21)
eval_21 = EvaluateLength(Curve=ext_7, Length=Slider(9.1, range=0..10), Normalized=False)  # -> simplify(Point), Tangent, Parameter
eval_22 = EvaluateLength(Curve=crv_8, Length=Slider(7, range=0..10), Normalized=False)  # -> Point, Tangent, Parameter
pl_23 = PlaneNormal(Origin=eval_21.Point, ZAxis=branch_17)
pl_24 = PlaneNormal(Origin=eval_22.Point, ZAxis=branch_17)
pipe_7 = Pipe(Curve=ext_7, Radius=Slider(3.5, range=0..10), Caps=0)  # -> simplify(Pipe)
pane_6 = PlaneSurface(Plane=pl_23, XSize=Domain(-10, 10), YSize=Domain(-10, 10))  # -> simplify(Plane)
planesrf_7 = PlaneSurface(Plane=pl_24, XSize=Domain(-10, 10), YSize=Domain(-10, 10))  # -> simplify(Plane)
split_13 = SplitBrep(Brep=pipe_7, Cutter=planesrf_7)
item_13 = ListItem(List=split_13, Index=0, Wrap=True)
split_14 = SplitBrep(Brep=item_13, Cutter=pane_6)
item_14 = ListItem(List=reverse(split_14), Index=0, Wrap=True)
cap_15 = CapHoles(Brep=item_14)

split_15 = SplitBrep(Brep=pipe_4, Cutter=planesrf_4)
item_15 = ListItem(List=split_15, Index=0, Wrap=True)
split_16 = SplitBrep(Brep=item_15, Cutter=pane_3)
item_16 = ListItem(List=reverse(split_16), Index=0, Wrap=True)
cap_16 = CapHoles(Brep=item_16)

sdiff_3 = SolidDifference(BrepsA=cap_16, BrepsB=cap_10)
sdiff_4 = SolidDifference(BrepsA=cap_13, BrepsB=cap_15)  # -> flatten(Result)

lng_5 = ListLength(List=sdiff_4)
series_5 = Series(Start=0, Step=Slider(27.084, range=0..50), Count=lng_5)
pt_12 = ConstructPoint(XCoordinate=series_5, YCoordinate=0, ZCoordinate=0)
xy_3 = XYPlane(Origin=pt_12)

join_5 = BrepJoin(Breps=[sdiff_3, cap_14])  # -> Breps, Closed
# In this case they all orient on top of each other, but it I try and orient like the faces of the panels they explode apart
orient_7 = Orient(Geometry=flatten(sdiff_4), Source=flatten(pl_19), Target=xy_3)  # -> Geometry, Transform
orient_8 = Orient(Geometry=join_5.Breps, Source=pln_2, Target=xy_2)  # -> Geometry, Transform
